# Grasshopper definition GraphSimpleExample.gh (Grasshopper 0.9.76)
# plug-ins: Python Interpreter

pipeline = GeometryPipeline(
    GroupByLayer=False,
    GroupByType=False,
    IncludeHidden=True,
    IncludeLocked=True,
    LayerFilter="AbstractNetwork",
    NameFilter="*",
    TypeFilter=4)
crv = Curve(pipeline)
python = PythonScript(AN=crv)  # -> out, Nodes, NodesIndices, NodesValency, Edges, EdgesIndices; inputs AN: list of Curve
# ---------- python: Python ----------
from scriptcontext import sticky as st
import ghpythonlib.components as ghcomp
import networkx as nx
import Pynet


#Defines undirected graph
Graph = nx.Graph()

#Tolerance  value for Line Topology
T = 0.01

#Extract Graph Information
Nodes = Pynet.GraphUtils.pointsToNXNodes(ghcomp.Sandbox_Topology.LineTopology(AN,T)[0], Graph)[0]
NodesIndices = Pynet.GraphUtils.pointsToNXNodes(ghcomp.Sandbox_Topology.LineTopology(AN,T)[0], Graph)[1]
Edges = AN
EdgesIndices = [tuple(l) for l in Pynet.ListUtils.chunksList(ghcomp.Sandbox_Topology.LineTopology(AN,T)[1],2)]
[Graph.add_edge(EdgesIndices[i][0], EdgesIndices[i][1]) for i in range(len(EdgesIndices))]

#Extract Valency at each node
NodesValency = [Graph.degree(i) for i in range(len(NodesIndices))]


#Print information
print str(len(Nodes))+' Nodes and '+str(len(Edges))+' Edges'
# ---------- end python ----------
python_2 = PythonScript(NodesIndices=python.NodesIndices, NodesValency=python.NodesValency, EdgesIndices=python.EdgesIndices, bool=Toggle(True))  # inputs NodesIndices: list, NodesValency: list of Int32, EdgesIndices: list, bool: Boolean
# ---------- python_2: Python ----------
from graphviz import Graph
import copy
import math
import Rhino.Geometry as rg
import scriptcontext
import System

#Body Attributes --------------------------#
g = Graph(format='bmp', engine='neato')


g.body.extend(['rankdir=LR', 'size="50"'])

#Nodes Attributes -------------------------#
g.node_attr.update(
shape = 'circle',
fontname = 'Arial',
fixedsize = 'true'
)

#Add NodesGroup0 --------------------------#
for i in range(len(NodesIndices)):
    
    g.node(
    
    NodesIndices[i],       # Node Group
    width = str(NodesValency[i]/1.7),      # Node Size
    color = 'black',  # Node Color
    penwidth= str(NodesValency[i]*4),         # Node Thickness
    fontsize = str(NodesValency[i]*20),      # Text Size
    labelloc = 'c',
    fontcolor = 'black',    # Text Color
    
    )

#Add EdgesIndices --------------------------#

StartEdgesIndices = []
EndEdgesIndices = []
for i in range(len(EdgesIndices)):
    StartEdgesIndices.append(str(EdgesIndices[i][0]))
    EndEdgesIndices.append(str(EdgesIndices[i][1]))

for i in range(len(StartEdgesIndices)):
    g.edge(
    
    StartEdgesIndices[i], EndEdgesIndices[i],  # Edge Group
    len=str(8),                    # Edge Length
    #color = str(ColorEdgesIndices[i]),        # Edge Color
    color = 'black',                      # Edge Color
    penwidth = str(3), # Edge Thickness

    style = 'dashed',                       # Edge Style
    
    fontname = 'Arial',         # Label Font
    fontcolor = 'black',                     # Label Color
    fontsize = '8',                          # Label Size
    
    )







folderpath = "C:\\Users\\Paul.Poinet\\Desktop"
view = scriptcontext.doc.Views.ActiveView
topView = scriptcontext.doc.Views.Find("Graph", False)

ScaleF = 150

if bool == True:
    filename = "2"

else:
    filename = "3"
filePath = folderpath+"\\"+filename+".bmp"



if bool == True:
    topView.ActiveViewport.ClearTraceImage()
    g.render(filename, folderpath, False, False)
    image = System.Drawing.Image.FromFile(filePath)
    W = image.Width
    H = image.Height
    image.Dispose()
    print W
    print H
    
    topView.ActiveViewport.SetTraceImage(filePath, rg.Plane.WorldXY, W/ScaleF, H/ScaleF,False,False)
else:
    topView.ActiveViewport.ClearTraceImage()
    view.ActiveViewport.ClearTraceImage()
    pass
# ---------- end python_2 ----------
tag = TextTag3D(
    Location=python.Nodes,
    Text=python.NodesIndices,
    Size=Slider(1, range=0..10),
    Colour=ColourSwatch(SwatchColor=RGB(0, 0, 0)),
    Justification=7)
