# Grasshopper definition TimberWorkflowExample.gh (Grasshopper 0.9.76)
# plug-ins: Karamba, Python Interpreter, Human, Weaverbird

pipeline = GeometryPipeline(
    GroupByLayer=False,
    GroupByType=False,
    IncludeHidden=True,
    IncludeLocked=True,
    LayerFilter="Network",
    NameFilter="*",
    TypeFilter=5)

number_slider = Slider(2, range=0..10)
pipeline_2 = GeometryPipeline(
    GroupByLayer=False,
    GroupByType=False,
    IncludeHidden=True,
    IncludeLocked=True,
    LayerFilter="Network",
    NameFilter="*",
    TypeFilter=4)

python = PythonScript(data=pipeline)  # -> out, AN, Supports; inputs data: list
# ---------- python: Python ----------
import Rhino.Geometry as rg 

Supports = []
AN = []
for dt in data:
    if type(dt) == rg.Point3d:
        Supports.append(dt)
    else:
        AN.append(dt)
# ---------- end python ----------
srf = Surface([<surface referenced from the Rhino model> x2])

backupfolderpath = Panel("C:\Users\Paul.Poinet\Documents\Visual Studio 2015\Projects\Pynet\Pynet")
plugins = BooleanToggle(True)
mesh = Mesh([<mesh referenced from the Rhino model> x2])
snapcolor = ColourSwatch(SwatchColor=RGB(61, 61, 61))
dl = DefinitionLibraries(Toggle=plugins)  # -> Core, Adds
# ---------- dl: Python ----------
"""
Analyses the Grasshopper document for which plugins it uses (both vanilla and third party).

    Inputs:
        Toggle: Activate the component using a boolean toggle {item,bool}
    Outputs:
        Core: Standard plugins {item,str}
        Adds: Third party plugins {item,str}
    Remarks:
        Author: Giulio Piacentino (updated by Anders Holden Deleuran)
        Version: 160120
"""
ghenv.Component.Name = "DefinitionLibraries"
ghenv.Component.NickName ="DL"
ghenv.Component.Category = "CITA CM6"
ghenv.Component.SubCategory = "1 Automation"

import Grasshopper as gh

def libraries():
    
    coreLibraries = {}
    addonLibraries = {}
    objids = {}
    
    server = gh.Instances.ComponentServer
    for obj in ghenv.Component.OnPingDocument().Objects:
        
        if obj == ghenv.Component:
            continue #Ignore this component.
            
        objId = obj.ComponentGuid
        if objids.has_key(objId):
            continue
        objids[objId] = ""
        
        lib = server.FindAssemblyByObject(obj)
        if lib == None:
            continue
        if coreLibraries.has_key(lib.Id) or addonLibraries.has_key(lib.Id):
            continue
            
        if lib.IsCoreLibrary:
            coreLibraries[lib.Id] = lib
        else:
            addonLibraries[lib.Id] = lib
            
    return coreLibraries, addonLibraries

if Toggle:
    coreLibraries, addonLibraries = libraries()
    
    Core = []
    for id, lib in coreLibraries.iteritems():
        Core.append("{0} {1}".format(lib.Name, lib.Version))
    
    Adds = []
    for id, lib in addonLibraries.iteritems():
        Adds.append("{0} {1}".format(lib.Name, lib.Version))
# ---------- end dl ----------
python_2 = PythonScript(killDisplays=Button())  # inputs killDisplays: Boolean
# ---------- python_2: Python ----------
import Pynet

if killDisplays == True:
    Pynet.DisplayUtils.killCustomDisplays()
# ---------- end python_2 ----------
loadpy = PythonScript(folder=backupfolderpath, reload=Button())  # -> out
# ---------- loadpy: Python ----------
# re-Import modules
import sys
if not _folder in sys.path:
    sys.path.append(_folder)

# Reloads Python modules 
def reload_module():

    import os
    import glob
    
    # filter only .py files from the directory folder
    files = os.listdir(_folder) 
    filtered_files = filter(lambda x: x.endswith(".py"), files) # filter(function,sequence) 
    # remove .py from filenames
    filenames = [file.split(".")[0] for file in filtered_files]

    # pop modules 
    print "Files in folder path that were reloaded: \n"
    for fn in filenames: 
        if sys.modules.has_key(fn):
            sys.modules.pop(fn)
        print fn

if _reload:
    reload_module()
# ---------- end loadpy ----------
demesh = DeconstructMesh(Mesh=mesh)  # -> flatten(Vertices), Faces, Colours, Normals
panel = Panel(dl.Adds)
python_3 = PythonScript(Geometry=Toggle(True), Vertices=demesh.Vertices, SnapLayer="ControlPoints", Color=snapcolor)  # -> out, a; inputs Geometry: Boolean, Vertices: list of Point3d
# ---------- python_3: Python ----------
import Rhino as rc
import rhinoscriptsyntax as rs
import scriptcontext as sc

if Geometry:
    
    # Unpack and get vertices
    points = Vertices
    
    # Set script context to rhino doc and disable drawing
    sc.doc = rc.RhinoDoc.ActiveDoc
    rs.EnableRedraw(False)
    
    # Make snaplayer
    
    if not rs.IsLayer(SnapLayer):
        rs.AddLayer(name=SnapLayer,color=Color,locked=True)
        
    # Delete/add geometry
    if rs.IsLayer(SnapLayer):
        
        # Set color
        rs.LayerColor(SnapLayer,Color)
        
        # Unlock and delete objects
        rs.LayerLocked(SnapLayer,False)
        snapObjs = rs.ObjectsByLayer(SnapLayer)
        rs.DeleteObjects(snapObjs)
        
        # Set to snaplayer, add points and lock layer
        cl = rs.CurrentLayer()
        rs.CurrentLayer(SnapLayer)
        rs.AddPointCloud(points)
        rs.CurrentLayer(cl)
        rs.LayerLocked(SnapLayer,True)
# ---------- end python_3 ----------

preview = CustomPreview(Geometry=srf, Shader=ColourSwatch(SwatchColor=RGB(214, 214, 214)))

# ---- group: Define global variables
sgv = PythonScript(MS=srf, AN=python.AN, TMS=Slider(0.1, range=0..0.1))  # inputs MS: list of Surface, AN: list of Curve
# ---------- sgv: Python ----------
import Grasshopper as gh
from scriptcontext import sticky as st
import scriptcontext as sc
import Grasshopper as gh
import Rhino.Geometry as rg


AN = [rg.Line(Crvs.PointAtStart, Crvs.PointAtEnd).ToNurbsCurve() for Crvs in [Crvs.ToNurbsCurve() for Crvs in AN]]

st['MasterSurfaces'] = MS
st['AbstractNetwork'] = AN
st['ThresholdMS'] = TMS
# ---------- end sgv ----------

# ---- group: Define Graph
python_4 = PythonScript()  # -> out, Graph, Nodes, NodesIndices, Edges
# ---------- python_4: Python ----------
from scriptcontext import sticky as st
import ghpythonlib.components as ghcomp
import networkx as nx
import Pynet

Key_AN = 'AbstractNetwork'
AN = st[Key_AN]


#Tolerance  value for Line Topology
if "T" not in globals():
    T = 0.01
    
#Defines undirected graph
Graph = nx.Graph()

Nodes = Pynet.GraphUtils.pointsToNXNodes(ghcomp.Sandbox_Topology.LineTopology(AN,T)[0], Graph)[0]
NodesIndices = Pynet.GraphUtils.pointsToNXNodes(ghcomp.Sandbox_Topology.LineTopology(AN,T)[0], Graph)[1]
Edges = AN
EdgesIndices = [tuple(l) for l in Pynet.ListUtils.chunksList(ghcomp.Sandbox_Topology.LineTopology(AN,T)[1],2)]

Pynet.GraphUtils.curvesToNXEdges(AN, EdgesIndices, Graph)

#Print information
print str(len(Nodes))+' N and '+str(len(Edges))+' E.'
# ---------- end python_4 ----------
graph_information = Panel(python_4.out)

# ----
python_5 = PythonScript(Graph=python_4.Graph)  # -> out, UpdatedEdges, newGraph, newNodes, newNodesIndices, newEdges, newEdgesIndices
# ---------- python_5: Python ----------
from scriptcontext import sticky as st
import Rhino.Geometry as rg
import networkx as nx
import Pynet
import System

#Define global variables
MS = st['MasterSurfaces']
TMS = st['ThresholdMS']
#Graph = st['Graph']

Edges = nx.get_edge_attributes(Graph, 'line').values()
EdgesIndices = nx.get_edge_attributes(Graph, 'line').keys()

newGraph = nx.Graph()
st['newGraph'] = newGraph

MSIndex = []
MSIndexEnds = []
for i in range(len(Edges)):
    stPoint = Edges[i].PointAtNormalizedLength(0.0)
    enPoint = Edges[i].PointAtNormalizedLength(1.0)
    a = []
    b = []
    Index = []
    IndexEnds = []
    for j in range(len(MS)):
        ClosestStPt = Pynet.GeoUtils.ClosestPtOnSurface(stPoint, MS[j])
        ClosestEnPt = Pynet.GeoUtils.ClosestPtOnSurface(enPoint, MS[j])
        a.append(ClosestStPt)
        b.append(ClosestEnPt)
        stDis = rg.Point3d.DistanceTo(a[j], stPoint)
        enDis = rg.Point3d.DistanceTo(b[j], enPoint)
        
        if stDis < TMS and enDis < TMS:
            Index.append([j])
        else:
            Index.append([])
        if stDis < TMS:
            IndexEnds.append((j, True))
        if enDis < TMS:
            IndexEnds.append((j, False))
    MSIndex.append(tuple(Pynet.ListUtils.flattenNestedList(Index)))
    
    MSIndexEnds.append(tuple(IndexEnds))

Dict = []
for i in range(len(MSIndex)):
    if not MSIndex[i]:
        Dict.append((MSIndexEnds[i],False))
    else:
        Dict.append((MSIndexEnds[i],True))

UpdatedEdges = []
for i in range(len(Edges)):

    if Dict[i][1] == False: #Check if segment does not rely on a master surface
    
        if len(Dict[i][0]) == 0: #Check if segment is completely isolated
            UpdatedEdges.append(Edges[i])
            newGraph.add_edge(EdgesIndices[i][0], EdgesIndices[i][1], isolated = UpdatedEdges[i]) #Add isolated attribute
            
        if len(Dict[i][0]) == 2: #Add surface-free segments with two points of contact with master surfaces
            if Dict[i][0][0][1] == True:
                Line = rg.Line(
                Pynet.GeoUtils.ClosestPtOnSurface(Edges[i].PointAtStart, MS[Dict[i][0][0][0]]),
                Pynet.GeoUtils.ClosestPtOnSurface(Edges[i].PointAtEnd, MS[Dict[i][0][1][0]]))
                UpdatedEdges.append(Line)
                newGraph.add_edge(EdgesIndices[i][0], EdgesIndices[i][1], surfaceTouch = UpdatedEdges[i]) #Add surfaceTouch attribute
            else:
                Line = rg.Line(
                Pynet.GeoUtils.ClosestPtOnSurface(Edges[i].PointAtEnd, MS[Dict[i][0][0][0]]),
                Pynet.GeoUtils.ClosestPtOnSurface(Edges[i].PointAtStart, MS[Dict[i][0][1][0]]))
                UpdatedEdges.append(Line)
                newGraph.add_edge(EdgesIndices[i][0], EdgesIndices[i][1], surfaceTouch = UpdatedEdges[i]) #Add surfaceTouch attribute
                
        if len(Dict[i][0]) == 1: #Add surface-free segments with one point of contact with a master surface
            if Dict[i][0][0][1] == True:
                Line = rg.Line(
                Pynet.GeoUtils.ClosestPtOnSurface(Edges[i].PointAtStart, MS[Dict[i][0][0][0]]),
                Edges[i].PointAtEnd)
                UpdatedEdges.append(Line)
                newGraph.add_edge(EdgesIndices[i][0], EdgesIndices[i][1], surfaceTouch = UpdatedEdges[i]) #Add surfaceTouch attribute
                
            else:
                Line = rg.Line(
                Pynet.GeoUtils.ClosestPtOnSurface(Edges[i].PointAtEnd, MS[Dict[i][0][0][0]]),
                Edges[i].PointAtStart)
                UpdatedEdges.append(Line)
                newGraph.add_edge(EdgesIndices[i][0], EdgesIndices[i][1], surfaceTouch = UpdatedEdges[i]) #Add surfaceTouch attribute
                
                
    else: # Segment relies on a master surface. Generates a closest curve on the respective master surface.
        # Get closest nurbs.
        PtsPara = rg.Curve.DivideByCount(Edges[i],1,True)
        a = []
        
        for j in range(len(PtsPara)):
            Pts = Edges[i].PointAt(PtsPara[j])
            PtsU = MS[MSIndex[i][0]].ClosestPoint(Pts)[1]
            PtsV = MS[MSIndex[i][0]].ClosestPoint(Pts)[2]
            a.append(MS[MSIndex[i][0]].Evaluate(PtsU, PtsV,0)[1])
        ClosestNurbs = rg.Curve.CreateInterpolatedCurve(a,3)
        #Divide closest nurbs and calculates average projection vector closest to the master surface
        AvVecs = []
        listVecs = []
        listParam = []
        listParam = ClosestNurbs.DivideByCount(5,False)
        for j in range(len(listParam)):
            Pts2 = ClosestNurbs.PointAt(listParam[j])
            PtU2 = MS[MSIndex[i][0]].ClosestPoint(Pts2)[1]
            PtV2 = MS[MSIndex[i][0]].ClosestPoint(Pts2)[2]
            MSClosestPts = MS[MSIndex[i][0]].Evaluate(PtU2, PtV2,0)[1]
            Vecs = rg.Point3d.Subtract(MSClosestPts, Pts2)
            listVecs.append(Vecs)
        AvVecs = Pynet.GeoUtils.AverageListVectors(listVecs)
        ProjectedNurbs = rg.Curve.ProjectToBrep(ClosestNurbs, MS[MSIndex[i][0]].ToBrep(), AvVecs,0.001)
        UpdatedEdges.append(ProjectedNurbs[0])
        newGraph.add_edge(EdgesIndices[i][0], EdgesIndices[i][1], surfaceBased = UpdatedEdges[i], surfaceIndex = MSIndex[i][0]) #Add surfaceBased attribute

# Gets the nodes information for generating a new graph
allPoints = []
UpdatedEdgesNurbs = []
for i in range(len(UpdatedEdges)):
    if type(UpdatedEdges[i]) == rg.Line:
        UpdatedEdgesNurbs.append(UpdatedEdges[i].ToNurbsCurve())
    else: 
        UpdatedEdgesNurbs.append(UpdatedEdges[i])
    allPoints.append(UpdatedEdgesNurbs[i].PointAtStart)
    allPoints.append(UpdatedEdgesNurbs[i].PointAtEnd)
OriginalGraphPtCloud = Pynet.GraphUtils.Graph2PtCloud(Graph)
UpdatedNodes = Pynet.GeoUtils.createPtCloudFromPoints(allPoints, 0.1).GetPoints() #just for deleting duplicates
UpdatedNodesIndices = [] 
for i in range(len(UpdatedNodes)):
    UpdatedNodesIndices.append(OriginalGraphPtCloud.ClosestPoint(UpdatedNodes[i]))

# Add information to a new graph and retrieves it.

for i in range(len(UpdatedEdges)):
    newGraph.add_edge(EdgesIndices[i][0], EdgesIndices[i][1], line = UpdatedEdges[i])
for i in range(len(UpdatedNodes)):
    newGraph.add_node(UpdatedNodesIndices[i], point = UpdatedNodes[i])


newNodes = nx.get_node_attributes(newGraph, 'point').values()
newNodesIndices = nx.get_node_attributes(newGraph, 'point').keys()
newEdges = nx.get_edge_attributes(newGraph, 'line').values()
newEdgesIndices = nx.get_edge_attributes(newGraph, 'line').keys()
print nx.get_edge_attributes(newGraph, 'line')
st['newNodes'] = newNodes
# ---------- end python_5 ----------
screentext = ScreenOrientedText(
    Text=python_5.newNodesIndices,
    Justification=5,
    Location=python_5.newNodes,
    SizeFactor=Slider(0.41, range=0..1),
    Color=ColourSwatch(SwatchColor=RGB(0, 0, 0)),
    Depth=0,
    Absolute=True)

list = ValueList({"K-Means": 0, "Cycles": 1, "SrfClusters": 2}, selected="K-Means")

previewmaxcurvature = BooleanToggle(True)
previewcurvature = BooleanToggle(True)

crv = Curve(python_5.newEdges)
python_6 = PythonScript(Crv=crv, t_trim=Slider(0, range=0..1), Res=Slider(0.05, range=0.05..10))  # -> out, Lines, MatricesDiff; inputs Crv: Curve
# ---------- python_6: Python ----------
import Rhino.Geometry as rg
import math as m

def TrimCrv(CrvToTrim, t):
    CrvToTrim.Domain = rg.Interval(0,1)
    TrimmedCrv = CrvToTrim.Trim(t_trim, 1-t_trim)
    return TrimmedCrv

def DivideByCount_GetPerpFrames(Crv, Res):
    if Crv.DivideByLength(Res, True) is None:
        segCount = 1
    else:
        segCount = len(Crv.DivideByLength(Res, True))
    arrParam = Crv.DivideByCount(segCount, True)
    perpFrames = [Crv.PerpendicularFrameAt(t)[1] for t in arrParam]
    return perpFrames

def Matrices(Frames):
    def shift(l, n):
        return l[n:] + l[:n]
    X = []
    Lines = []
    for i in range(len(Frames)):
        X.append(rg.Transform.PlaneToPlane(Frames[i], shift(Frames, 1)[i]))
        Lines.append(rg.Line(Frames[i].Origin, shift(Frames, 1)[i].Origin))
    X.pop(-1)
    Lines.pop(-1)
    return X, Lines

def MatricesDiff(listMatrices):
    
    Rot00 = [tr[0,0] for tr in listMatrices]
    Rot10 = [tr[1,0] for tr in listMatrices]
    Rot20 = [tr[2,0] for tr in listMatrices]
    Rot21 = [tr[2,1] for tr in listMatrices]
    Rot22 = [tr[2,2] for tr in listMatrices]
    
    transX = []
    transY = []
    transZ = []
    for i in range(len(listMatrices)):
        transX.append(abs(m.atan2(Rot21[i], Rot22[i])))
        transY.append(abs(m.atan2(-Rot20[i],m.sqrt(m.pow(Rot21[i],2)+m.pow(Rot22[i],2)))))
        transZ.append(abs(m.atan2(Rot10[i], Rot00[i])))
        
    maxTransXYZ = []
    for i in range(len(transX)):
        maxTransXYZ.append(max(transX[i], transY[i], transZ[i]))
        
    return maxTransXYZ


TrimmedCrv = TrimCrv(Crv, t_trim)
perpFrames = DivideByCount_GetPerpFrames(TrimmedCrv, Res)
X = Matrices(perpFrames)[0]
Lines = Matrices(perpFrames)[1]
MatricesDiff = MatricesDiff(X)
# ---------- end python_6 ----------
python_7 = PythonScript(
    PreviewCurvature=previewcurvature,
    PreviewMaxCurvature=previewmaxcurvature,
    Lines=python_6.Lines,
    MatricesDiff=python_6.MatricesDiff)  # inputs PreviewCurvature: Boolean, Lines: tree of Line, MatricesDiff: tree
# ---------- python_7: Python ----------
import Rhino.Geometry as rg
import Rhino as rc
from scriptcontext import sticky as st
import Pynet

def customDisplay(toggle,component):
    
    """ Make a custom display which is unique to the component and lives in sticky """
    
    # Make unique name and custom display
    displayGuid = "customDisplay_" + str(component.InstanceGuid)
    if displayGuid not in st:
        st[displayGuid] = rc.Display.CustomDisplay(True)
        
    # Clear display each time component runs
    st[displayGuid].Clear()
    
    # Return the display or get rid of it
    if toggle:
        return st[displayGuid]
    else:
        st[displayGuid].Dispose()
        del st[displayGuid]
        return None
dis = customDisplay(True, ghenv.Component)

Lines_nList = Pynet.ListUtils.ghDataTreeToPythonList(Lines)
MatricesDiff_nList = Pynet.ListUtils.ghDataTreeToPythonList(MatricesDiff)
MaxTrans = max(Pynet.ListUtils.flattenNestedList(MatricesDiff_nList))

# Remap values for colorization
def remapValue(OldValue, OldMin, OldMax, NewMin, NewMax):
    
    OldRange = (OldMax - OldMin)  
    NewRange = (NewMax - NewMin)  
    NewValue = (((OldValue - OldMin) * NewRange) / OldRange) + NewMin
    
    return NewValue



# Preview Curvature

if PreviewCurvature:
    for i in range(len(MatricesDiff_nList)):
        NewValues = []
        LinesToJoin = []
        for j in range(len(MatricesDiff_nList[i])):
            NewValue = remapValue(MatricesDiff_nList[i][j], MaxTrans, 0, 0, 1)
            NewValues.append(NewValue)
            LinesToJoin.append(Lines_nList[i][j].ToNurbsCurve())
            if PreviewMaxCurvature == False:
                color = rc.Display.ColorXYZ(NewValue,NewValue,NewValue)
                dis.AddLine(Lines_nList[i][j],color,10)
        if PreviewMaxCurvature == True:
            colorMax = rc.Display.ColorXYZ(min(NewValues),min(NewValues),min(NewValues))
            PolyLine = rg.Curve.JoinCurves(LinesToJoin)[0]
            dis.AddCurve(PolyLine,colorMax,10)
# ---------- end python_7 ----------

# ---- group: gets cycles
python_8 = PythonScript(Graph=python_5.newGraph, PartitionningMethod=list)  # -> out, NodesTuples, NodesKeys, Cycles, CyclesNodes, CyclesCurves, clusteredObjects
# ---------- python_8: Python ----------
from scriptcontext import sticky as st
import Pynet
import Rhino.Geometry as rg
import networkx as nx

MS = st['MasterSurfaces']
TMS = st['ThresholdMS']



#Graph = st['newGraph']

if PartitionningMethod == 0:
    
    Nodes = nx.get_node_attributes(Graph, 'point').values()
    NodesIndices = Graph.nodes()
    NodesTuples = []
    
    
    NodesKeys = []
    for i in range(len(Nodes)):
        NodesTuples.append((Nodes[i], NodesIndices[i]))
        NodesKeys.append([Nodes[i].X, Nodes[i].Y, Nodes[i].Z])
    NodesKeys = Pynet.ListUtils.pythonListTGhDataTree(NodesKeys, float)
    
if PartitionningMethod == 1:
    Cycles = Pynet.GraphUtils.findAllCyclesInGraph(Graph)
    CyclesNodes = Pynet.GraphUtils.getCyclesGeometry(Cycles, Graph)[0]
    CyclesNodes = Pynet.ListUtils.pythonListTGhDataTree(CyclesNodes, rg.Point3d)
    CyclesCurves = Pynet.GraphUtils.getCyclesGeometry(Cycles, Graph)[1]
    
if PartitionningMethod == 2:
    Nodes = nx.get_node_attributes(Graph, 'point').values()
    NodesIndices = Graph.nodes()
    Index = []
    sumListBool = []
    for i in range(len(Nodes)):
        a = []
        Index.append(a)
        for j in range(len(MS)):
            ClosestStPtToSrf = Pynet.GeoUtils.ClosestPtOnSurface(Nodes[i], MS[j])
            Dis = rg.Point3d.DistanceTo(Nodes[i], ClosestStPtToSrf)
            if Dis < TMS:
                a.append([j])
            if Dis > TMS:
                a.append([])
    ClusterIndices = []
    for sublists in Index:
        ClusterIndices.append(Pynet.ListUtils.flattenNestedList(sublists))
    listClusterIndices = []
    for i in range(len(ClusterIndices)):
        if not ClusterIndices[i]:
            listClusterIndices.append(None)
        else:
            listClusterIndices.append(ClusterIndices[i][0])
    
    dict1 = {}
    for i in range(len(Nodes)):
        dict1.update({Nodes[i]: listClusterIndices[i]})
    ClusterDict = Pynet.DictUtils.ClusterDict(dict1)
    PatchesNodes = ClusterDict.values()
    dict2 = {}
    for i in range(len(NodesIndices)):
        dict2.update({NodesIndices[i]: listClusterIndices[i]})
    ClusterDict2 = Pynet.DictUtils.ClusterDict(dict2)
    PatchesNodesIndices = ClusterDict2.values()
    clusteredObjects = []
    for i in range(len(PatchesNodes)):
        a = []
        clusteredObjects.append(a)
        for j in range(len(PatchesNodes[i])):
            a.append((PatchesNodes[i][j],PatchesNodesIndices[i][j]))
            
    clusteredObjects = Pynet.ListUtils.pythonListTGhDataTree(clusteredObjects, tuple)
# ---------- end python_8 ----------

# ----
numberofclusters = Slider(2, range=1..20)

# ---- group: Create K-Means
c_script = CSharpScript(objects=python_8.NodesTuples, keys=python_8.NodesKeys, k=numberofclusters, maxIterations=30)  # -> out, clusteredObjects; inputs objects: list, keys: tree of Double, k: Int32, maxIterations: Double
# ---------- c_script: C# ----------
    //check data is ok.
    if(objects == null || keys == null)
    {
      Print("Please set objects and keys");
      return;
    } else if(objects.Count != keys.BranchCount)
    {
      Print("Keys do not match objects");
      return;
    } else if(k <= 0 || maxIterations <= 0)
    {
      Print("K and max iterations need to be > 0");
      return;
    }

    //set up the vectors. Each vector coresponds to an object.
    int vectorLength = keys.Branch(0).Count;
    vector[] vectors = new vector[objects.Count];
    for(int i = 0; i < vectors.Length; i++)
    {
      vectors[i] = new vector(keys.Branch(i));
      if(vectors[i].getVector().Length != vectorLength)
      {
        Print("Keys are not the same length");
        return;
      }
    }

    //set up the clusters, each vector represents the center of the cluster
    vector[] clusters = new vector[k];
    int step = (int) Math.Floor((double) (objects.Count / k));

    for(int i = 0; i < clusters.Length; i++)
    {
      clusters[i] = new vector(keys.Branch(i * step));
    }



    //Now assign the vectors to their nearest cluster
    //and move the cluster center to the middle of the vectors.
    //Repeat until they do not change, or max iterations is reached.
    bool changed = true;
    int n = 0;

    while(changed == true && n < maxIterations)
    {
      changed = false;

      //put the vector into its closest cluster.
      for(int i = 0; i < vectors.Length; i++)
      {
        int bestId = 0;
        double bestDistance = vectors[i].distance(clusters[0]);

        for(int j = 0; j < clusters.Length; j++)
        {
          double testDistance = vectors[i].distance(clusters[j]);
          if(testDistance < bestDistance)
          {
            bestDistance = testDistance;
            bestId = j;
          }
        }

        if(vectors[i].getCluster() != bestId)
        {
          vectors[i].setCluster(bestId);
          changed = true;
        }
      }


      //reset the clusters to the centroids of all the vectors in the cluster.
      double[,] newCentroids = new double[clusters.Length, vectors[0].getVector().Length];
      int[] count = new int[clusters.Length];

      foreach(vector v in vectors)
      {
        double[] myVector = v.getVector();
        for(int i = 0; i < myVector.Length; i++)
        {
          newCentroids[v.getCluster(), i] += myVector[i];
        }
        count[v.getCluster()]++;
      }

      for(int i = 0; i < newCentroids.GetLength(0); i++)
      {
        double[] newCentroid = new double[newCentroids.GetLength(1)];

        for(int j = 0; j < newCentroids.GetLength(1); j++)
        {
          newCentroid[j] = newCentroids[i, j] / count[i];
        }

        clusters[i].setVector(newCentroid);
      }

      n++;
    }

    String text = "took " + n + " iterations";
    Print(text);


    //now groups all the objects into clusters to be outputted.
    DataTree<object> objectsOut = new DataTree<object>();
    for(int i = 0; i < vectors.Length; i++)
    {
      Grasshopper.Kernel.Data.GH_Path path = new Grasshopper.Kernel.Data.GH_Path(vectors[i].getCluster());
      objectsOut.Add(objects[i], path);
    }

    clusteredObjects = objectsOut;
# ---------- c_script: C# additional code ----------
  /// <summary>
  /// Holds the vector as an array of doubles.
  /// And the cluster it is in as an integer.
  /// </summary>
  class vector
  {
    int cluster = 0;
    double[] myVector;

    public vector(List<double> _myVector)
    {
      myVector = _myVector.ToArray();
    }

    //######################
    // GETS
    //######################

    /// <summary>
    ///
    /// </summary>
    /// <returns></returns>
    public int getCluster()
    {
      return cluster;
    }

    public double[] getVector()
    {
      return myVector;
    }

    //######################
    // SETS
    //######################

    public void setVector(double[] _myVector)
    {
      myVector = _myVector;
    }

    public void setCluster(int _cluster)
    {
      cluster = _cluster;
    }

    //######################
    // METHODS
    //######################

    public double distance(vector otherV)
    {
      double[] otherVector = otherV.getVector();
      double distance = 0;

      if(myVector.Length == otherVector.Length)
      {
        for(int i = 0; i < myVector.Length; i++)
        {
          distance += Math.Pow(myVector[i] - otherVector[i], 2);
        }
        distance = Math.Sqrt(distance);
      }

      return distance;
    }
  }
# ---------- end c_script ----------
panel_2 = Panel(c_script.out)

# ---- group: Create patches
python_9 = PythonScript(Cycles=python_8.Cycles, CyclesNodes=python_8.CyclesNodes, CyclesCurves=python_8.CyclesCurves)  # -> out, clusteredObjects; inputs Cycles: list, CyclesNodes: tree of Point3d, CyclesCurves: list of Polyline
# ---------- python_9: Python ----------
from scriptcontext import sticky as st
import itertools
import networkx as nx
import copy
import Pynet
import Rhino.Geometry as rg


if Cycles[0] is not None: # So the gh component doesn't turn red.

##--- Finds biggest Cycles ---##

    Graph = st['newGraph']
    CyclesIndices = Pynet.GraphUtils.CyclesTopologyEdges(Cycles, CyclesCurves, Graph)[1]
    
    #Find all cycles for each edge
    newCycles = []
    lenNewCycles = []
    for i in range(len(CyclesIndices)):
        a = []
        lenA = []
        newCycles.append(a)
        lenNewCycles.append(lenA)
        for j in range(len(CyclesIndices[i])):
            a.append(Cycles[CyclesIndices[i][j]])
            lenA.append(len(Cycles[CyclesIndices[i][j]]))
    
    sortedL = []
    for i in range(len(lenNewCycles)):
        sortedL.append(Pynet.ListUtils.sortListWithKeys(lenNewCycles[i], newCycles[i])[0])
        
    #Find biggest patches
    sortedL = Pynet.ListUtils.findDupSublistsInNestedList(sortedL)[0]
    #Find non overlapping biggest patches
    NonOverlappingKCliques = Pynet.GraphUtils.getNonOverlappingKCliques(sortedL)
    
    #Computes IndexNakedSingleNode and IndexNakedSingleNodeNeighbor
    IndexNakedSingleNode = Pynet.GraphUtils.getIndexNakedSingleNodeAndNeighbor(Graph)[0]
    IndexNakedSingleNodeNeighbor = Pynet.GraphUtils.getIndexNakedSingleNodeAndNeighbor(Graph)[1]
    
    #Adds IndexNakedSingleNode to Cycles
    for i in range(len(NonOverlappingKCliques)):
        for j in range(len(IndexNakedSingleNodeNeighbor)):
            if IndexNakedSingleNodeNeighbor[j] in NonOverlappingKCliques[i]:
                NonOverlappingKCliques[i].append(IndexNakedSingleNode[j])
            else:
                pass
    
    
    ##--- Find remaining Cycles ---##
    
    #Gets remaining nodes
    NodesIndices = Graph.nodes()
    for i in Pynet.ListUtils.flattenNestedList(NonOverlappingKCliques):
        NodesIndices.remove(i)
    
    # Find naked nodes to add for remaining Cycles
    fictionEdges = []
    for i in itertools.permutations(NodesIndices, 2):
        fictionEdges.append(i)
    intersection = set(fictionEdges) & set(Graph.edges())
    EdgesToAdd = map(list, intersection)
    EdgesToAdd = [tuple(l) for l in EdgesToAdd]
    
    # Create a fiction graph to find remaining Cycles
    fictionGraph = nx.Graph()
    for i in range(len(EdgesToAdd)):
        fictionGraph.add_edge(EdgesToAdd[i][0], EdgesToAdd[i][1])
    
    # Get remaining Cycles
    remainingCycles = []
    fictionSubgraphs = nx.connected_component_subgraphs(fictionGraph)
    for i in range(len(fictionSubgraphs)):
        remainingCycles.append(list(set(sum(fictionSubgraphs[i].edges(), ()))))
    
    
    ##--- Merge all Cycles ---##
    
    # Merge cycles
    for i in range(len(remainingCycles)):
        NonOverlappingKCliques.append(remainingCycles[i])
    
    
    ##--- Find remaining nodes and merge ---##
    
    flattenNonOverlappingKCliques = Pynet.ListUtils.flattenNestedList(NonOverlappingKCliques)
    GraphNodes = Graph.nodes()
    
    arrayPts = []
    for i in range(len(flattenNonOverlappingKCliques)):
        GraphNodes.remove(flattenNonOverlappingKCliques[i])
        arrayPts.append(nx.get_node_attributes(Graph, 'point').values()[flattenNonOverlappingKCliques[i]])
    PtCloud = rg.PointCloud(arrayPts)
    
    ClosestPts = []
    ClosestIndices = []
    OriginalGraphNodes = nx.get_node_attributes(Graph, 'point').values()
    OriginalPtCloud = rg.PointCloud(OriginalGraphNodes)
    for i in range(len(GraphNodes)):
        ClosestPts.append(arrayPts[rg.PointCloud.ClosestPoint(PtCloud, OriginalGraphNodes[GraphNodes[i]])])
        ClosestIndices.append(OriginalPtCloud.ClosestPoint(ClosestPts[i]))
    
    for i in range(len(ClosestIndices)):
        for j in range(len(NonOverlappingKCliques)):
            if ClosestIndices[i] in NonOverlappingKCliques[j]:
                NonOverlappingKCliques[j].append(GraphNodes[i])
            else:
                pass
    
    # Outputs all Cycles
    AllCycles = []
    for i in range(len(NonOverlappingKCliques)):
        a = []
        AllCycles.append(a)
        for j in range(len(NonOverlappingKCliques[i])):
            a.append(nx.get_node_attributes(Graph, 'point').values()[NonOverlappingKCliques[i][j]])
    
    # Creates tuples with indices and outputs
    clusteredObjects = []
    for i in range(len(AllCycles)):
        a = []
        clusteredObjects.append(a)
        for j in range(len(AllCycles[i])):
            a.append((AllCycles[i][j], NonOverlappingKCliques[i][j]))
    clusteredObjects = Pynet.ListUtils.pythonListTGhDataTree(clusteredObjects, tuple)
# ---------- end python_9 ----------

# ----
filter = StreamFilter(Gate=list, Stream0=c_script.clusteredObjects, Stream1=python_9.clusteredObjects, Stream2=python_8.clusteredObjects)
python_10 = PythonScript(x=filter)  # -> PatchesNodes, PatchesNodesIndices; inputs x: tree
# ---------- python_10: Python ----------
import Rhino.Geometry as rg
import Pynet

NodesTuples = Pynet.ListUtils.ghDataTreeToPythonList(x)

PatchesNodes = []
PatchesNodesIndices = []

for i in range(len(NodesTuples)):
    a = []
    b = []
    PatchesNodes.append(a)
    PatchesNodesIndices.append(b)
    for j in range(len(NodesTuples[i])):
        a.append(NodesTuples[i][j][0])
        b.append(NodesTuples[i][j][1])

PatchesNodes = Pynet.ListUtils.pythonListTGhDataTree(PatchesNodes, rg.Point3d)
PatchesNodesIndices = Pynet.ListUtils.pythonListTGhDataTree(PatchesNodesIndices, int)
# ---------- end python_10 ----------
slider_updater = SliderDomainUpdater(Updater=python_10.PatchesNodesIndices)  # inputs Updater: tree
# ---------- slider_updater: Python ----------
"""
Reset a named slider's domain.
    Inputs:
        Sliders: List of slider NickNames.
        Min: Minimum Value(s).
        Max: Maximum value(s).
        Update: Set to 'True' to update the slider's domain.
"""

# Import libraries
import Grasshopper as gh

# Get GH objects
gh_objects = ghenv.Component.OnPingDocument().Objects
Sliders = ["PatchNumber","NodeIndex"]
MaxVal_PatchNumber = Updater.BranchCount-1
MaxVal_NodeIndex = len(Updater.AllData())-1

# Iterate objects
for obj in gh_objects:
    # Find components with given NickNames
    if obj.NickName in Sliders:
        if obj.NickName == 'PatchNumber':
            # Get [Number Slider] objects with NickNames
            if type(obj) is gh.Kernel.Special.GH_NumberSlider:
                # Set minimum and maximum values
                obj.Slider.Minimum = 0
                obj.Slider.Maximum = MaxVal_PatchNumber
                obj.Slider.Value = 0
                # Update sliders
                obj.ExpireSolution(True)
        elif obj.NickName == 'NodeIndex':
            # Get [Number Slider] objects with NickNames
            if type(obj) is gh.Kernel.Special.GH_NumberSlider:
                # Set minimum and maximum values
                obj.Slider.Minimum = 0
                obj.Slider.Maximum = MaxVal_NodeIndex
                # Update sliders
                obj.ExpireSolution(True)
                obj.ExpireSolution(False)
# ---------- end slider_updater ----------

previewclusters = BooleanToggle(True)

patchnumber = Slider(0, range=0..1)
selectionmode = Slider(1, range=0..2)
nodeindex = Slider(1, range=0..16)

python_11 = PythonScript(PreviewClusters=previewclusters, P=python_10.PatchesNodes)  # -> out, A; inputs PreviewClusters: Boolean, P: list of Point3d
# ---------- python_11: Python ----------
import clr
clr.AddReference("MIConvexHull")
import MIConvexHull
from System import Array, Double
import Rhino.Geometry as rg


if len(P) == 1:
    pass
        
else:
    
    if PreviewClusters == True:
        Ilist = []
        
        # Create a list of arrays for creating the convex hull through MIConvexHull
        for i in range(len(P)):
            arr = Array.CreateInstance(Double, 3)
            x = Double(P[i].X)
            y = Double(P[i].Y)
            z = Double(P[i].Z)
            listDoubles = [x,y,z]
            for j in range(len(listDoubles)):
                arr[j] = listDoubles[j]
            Ilist.append(arr)
        
        # Create a rhino mesh
        ListVertices = []
        CHullMesh = rg.Mesh()
        hull = MIConvexHull.ConvexHull.Create(Ilist)
        count = 0
        for face in hull.Faces:
            for i in range(3):
                CHullMesh.Vertices.Add(rg.Point3d(face.Vertices[i].Position[0], face.Vertices[i].Position[1], face.Vertices[i].Position[2]))
            CHullMesh.Faces.AddFace(count, count+1, count+2)
            count += 3
        CHullMesh.Normals.ComputeNormals()
        
        # Output
        A = CHullMesh
    else:
        pass
# ---------- end python_11 ----------
python_12 = PythonScript(T=python_10.PatchesNodesIndices, P=patchnumber)  # -> B; inputs T: tree
# ---------- python_12: Python ----------
B = T.Branch(P)
# ---------- end python_12 ----------
python_13 = PythonScript(Nodes_Gen=selectionmode, in0=nodeindex, in1=python_12)  # -> out, Selected_NodesIndices; inputs Nodes_Gen: Int32, in0: Int32, in1: list of Int32
# ---------- python_13: Python ----------
from scriptcontext import sticky as st
import networkx as nx
import Pynet

Graph = st['newGraph']
NodesIndices = nx.get_node_attributes(Graph, 'point').keys()

if Nodes_Gen == 0:
    Selected_NodesIndices = in0
if Nodes_Gen == 1:
    Selected_NodesIndices = in1
if Nodes_Gen == 2:
    Selected_NodesIndices = NodesIndices
# ---------- end python_13 ----------
python_14 = PythonScript(SelectionMode=selectionmode)  # -> out; inputs SelectionMode: Int32
# ---------- python_14: Python ----------
if SelectionMode == 0:
    print '---'
    print 'Single Node Selection'
    print '---'
if SelectionMode == 1:
    print '---'
    print 'Patch Selection'
    print '---'
if SelectionMode == 2:
    print '---'
    print 'All Nodes Selection'
    print '---'
# ---------- end python_14 ----------
selectionmode_2 = Panel(python_14)
selected_nodesindices = Panel(python_13.Selected_NodesIndices)
subdivision_u = Slider(0.609, range=0.1..1)
pointcloud = BooleanToggle(False)
number_slider_2 = Slider(20, range=2..100)
mesh_2 = Mesh(python_11.A)
sections = BooleanToggle(True)
cluster = Cluster_2(x=mesh_2)
preview_2 = CustomPreview(Geometry=python_11.A, Shader=ColourSwatch(SwatchColor=RGBA(255, 184, 184, 57)))
data = Data(selected_nodesindices)

profilethickness = Slider(0.25, range=0..1)
generatenodes = BooleanToggle(True)
fillet = Slider(0.1, range=0..0.2)
number_slider_3 = Slider(0.25, range=0..1)

addition = Addition(A=number_slider_3, B=Slider(0, range=0..0.1))
python_15 = PythonScript(ProfileThickness=profilethickness, t=addition, fillet=fillet)  # -> out, Edges_SrfTouch_Trimmed, Edges_SrfBased_Trimmed, ListProfiles, ListProfiles_SrfBased
# ---------- python_15: Python ----------
##----------------------------------------------------------------------------------------------------
## Import internal libraries
import Rhino.Geometry as rg
import rhinoscriptsyntax as rs
from scriptcontext import sticky as st
from ghpythonlib import components as ghcomp
from copy import deepcopy
import math as m

## Import external libraries
import networkx as nx
import Pynet

##----------------------------------------------------------------------------------------------------
## Global variables

Graph = st['newGraph']
MS = st['MasterSurfaces']
Nodes = nx.get_node_attributes(Graph, 'point').values()
Edges = nx.get_edge_attributes(Graph, 'line').values()

Edges_Isolated = nx.get_edge_attributes(Graph, 'isolated').values()
Edges_SrfTouch = nx.get_edge_attributes(Graph, 'surfaceTouch').values()
Edges_SrfBased = nx.get_edge_attributes(Graph, 'surfaceBased').values()
MasterSrf_Indices = nx.get_edge_attributes(Graph, 'surfaceIndex').values()

def ExtractEdgeInBetween(Edges):
    Edges_Nurbs = [Crv.ToNurbsCurve() for Crv in Edges]
    for Crv in Edges_Nurbs:
        Crv.Domain = rg.Interval(0,1)
    Edges_Trimmed = [Crv.Trim(t, 1-t) for Crv in Edges_Nurbs]
    return Edges_Trimmed  
    
Edges_Isolated_Trimmed = ExtractEdgeInBetween(Edges_Isolated)
Edges_SrfTouch_Trimmed = ExtractEdgeInBetween(Edges_SrfTouch)
Edges_SrfBased_Trimmed = ExtractEdgeInBetween(Edges_SrfBased)


Edges_Isolated_Trimmed.extend(Edges_SrfTouch_Trimmed)

ListProfiles = []
for Crv in Edges_Isolated_Trimmed:
    ArrayFloat = Crv.DivideByCount(1,True)
    ListFrames = []
    for f in ArrayFloat:
        Frames = Crv.PerpendicularFrameAt(f)[1]
        ListFrames.append(Frames)
    Profiles = Pynet.GeoUtils.RectanglesFromPlanesOrigins(ListFrames, ProfileThickness, True, fillet)
    ListProfiles.append(Profiles)


ListProfiles_Oriented = []
for i in range(len(Edges_SrfBased_Trimmed)):
    ArrayFloat = Edges_SrfBased_Trimmed[i].DivideByCount(1,True)
    OrientedFrames = []
    
    for f in ArrayFloat:
        Frames = Edges_SrfBased_Trimmed[i].PerpendicularFrameAt(f)[1]

        LocalMS = MS[MasterSrf_Indices[i]]
        UV = LocalMS.ClosestPoint(Frames.Origin)
        SrfFrame = LocalMS.FrameAt(UV[1], UV[2])[1]
        SrfFrameO = SrfFrame.Origin
        SrfFrameZ = SrfFrame.ZAxis
        OrientedFrames.append(rg.Plane(SrfFrameO, SrfFrameZ, Frames.XAxis))
    Profiles = Pynet.GeoUtils.RectanglesFromPlanesOrigins(OrientedFrames, ProfileThickness, True, fillet)
    ListProfiles_Oriented.append(Profiles)


def FlipSameDirection(ChunkSections):
    import math as m
    a = []
    ptA = ghcomp.CurveProximity(ChunkSections[0], ChunkSections[1])[0]
    ptB = ghcomp.CurveProximity(ChunkSections[0], ChunkSections[1])[1]
    paramA = ChunkSections[0].ClosestPoint(ptA)[1]
    paramB = ChunkSections[1].ClosestPoint(ptB)[1]
    adjustedCrv0 = ghcomp.Seam(ChunkSections[0], paramA)
    adjustedCrv1 = ghcomp.Seam(ChunkSections[1], paramB)
    angleSeam = m.degrees(rg.Vector3d.VectorAngle(adjustedCrv0.TangentAt(0), adjustedCrv1.TangentAt(0)))
    if angleSeam > 90:
        adjustedCrv0.Reverse()
    else:
        pass
    a.append(adjustedCrv0)
    a.append(adjustedCrv1)
    return a

ListProfiles_SrfBased = []
for i in range(len(ListProfiles_Oriented)):
    ListProfiles_SrfBased.append(FlipSameDirection(ListProfiles_Oriented[i]))
print ListProfiles_SrfBased
# ---------- end python_15 ----------
python_16 = PythonScript(PointCloud=pointcloud, MeshEdges=Toggle(True), Sections=sections, PreviewGeo=cluster)  # inputs PointCloud: Boolean, MeshEdges: Boolean, PreviewGeo: tree
# ---------- python_16: Python ----------
import Rhino.Geometry as rg
import Grasshopper as gh
import Rhino as rc
import scriptcontext
from scriptcontext import sticky as st


def customDisplay(toggle,component):
    
    """ Make a custom display which is unique to the component and lives in sticky """
    
    # Make unique name and custom display
    displayGuid = "customDisplay_" + str(component.InstanceGuid)
    if displayGuid not in st:
        st[displayGuid] = rc.Display.CustomDisplay(True)
        
    # Clear display each time component runs
    st[displayGuid].Clear()
    
    # Return the display or get rid of it
    if toggle:
        return st[displayGuid]
    else:
        st[displayGuid].Dispose()
        del st[displayGuid]
        return None

# Unpack tree
PC,ME = [b for b in PreviewGeo.Branches]
Toggle = True
dis = customDisplay(Toggle,ghenv.Component)

ps1 = rc.Display.PointStyle.Simple

if PreviewGeo.DataCount:

    if PointCloud:
        color = rc.Display.ColorXYZ(0,0,0)
        dis.AddPoints(PC,color,ps1,40)
    if MeshEdges:
        for i in range(len(ME)):
            color = rc.Display.ColorXYZ(0.0,0.0,0.0)
            dis.AddLine(ME[i],color,2)
# ---------- end python_16 ----------
divlength = DivideLength(Curve=python_15.Edges_SrfTouch_Trimmed, Length=subdivision_u)  # -> Points, Tangents, Parameters
divlength_2 = DivideLength(Curve=python_15.Edges_SrfBased_Trimmed, Length=subdivision_u)  # -> Points, Tangents, Parameters
generatebeams = BooleanToggle(True)
python_17 = PythonScript(GenerateGeometry=generatenodes, ProfileThickness=profilethickness, t=number_slider_3, fillet=fillet, item=data)  # -> out, CHullMesh, Sections, simplify(graft(Rails)); inputs GenerateGeometry: Boolean, item: Int32
# ---------- python_17: Python ----------
##----------------------------------------------------------------------------------------------------
## Import internal libraries
import Rhino.Geometry as rg
import rhinoscriptsyntax as rs
from scriptcontext import sticky as st
from ghpythonlib import components as ghcomp
from copy import deepcopy
import math as m

## Import external libraries
import networkx as nx
import Pynet

##----------------------------------------------------------------------------------------------------
## Global variables

Graph = st['newGraph']
MS = st['MasterSurfaces']
Nodes = nx.get_node_attributes(Graph, 'point').values()
Edges = nx.get_edge_attributes(Graph, 'line').values()

##----------------------------------------------------------------------------------------------------
## Get all neighboring edges and neighboring nodes

NodeNeighborsEdges = []
NodeNeighborsIndices = []
SurfaceIndices = []
for i in range(len(Graph[item].values())):
    if 'isolated' in Graph[item].values()[i]:
        NodeNeighborsEdges.append(Graph[item].values()[i].get('isolated').ToNurbsCurve())
        NodeNeighborsIndices.append(Graph[item].keys()[i])
        
    elif 'surfaceTouch' in Graph[item].values()[i]:
        NodeNeighborsEdges.append(Graph[item].values()[i].get('surfaceTouch').ToNurbsCurve())
        NodeNeighborsIndices.append(Graph[item].keys()[i])
        
    elif 'surfaceBased' in Graph[item].values()[i]:
        NodeNeighborsEdges.append(Graph[item].values()[i].get('surfaceBased').ToNurbsCurve())
        NodeNeighborsIndices.append(Graph[item].keys()[i])
        SurfaceIndices.append(Graph[item].values()[i].values()[0])
if not SurfaceIndices:
    pass
else:
    SurfaceGlobalIndex = SurfaceIndices[0]

##----------------------------------------------------------------------------------------------------
## Generates all Rails and Sections

if len(NodeNeighborsIndices) >= 2: # If node is isolated, dismiss this entire section.

    ##----------------------------------------------------------------------------------------------------
    ## Basic geometrical sorting before further processing.
    
    # Sorts neighboring edges/curves (from main node to exterior)
    fromCenterToEndNodeEdges = []
    sortedEdges = []
    for i in range(len(NodeNeighborsIndices)):
        sortedEdges.append(rg.Line(Nodes[item], Nodes[NodeNeighborsIndices[i]]))
        if sortedEdges[i].From.DistanceTo(NodeNeighborsEdges[i].PointAtStart) < 0.1:
            fromCenterToEndNodeEdges.append(NodeNeighborsEdges[i])
        else:
            nE = NodeNeighborsEdges[i]
            nE.Reverse()
            fromCenterToEndNodeEdges.append(nE)
            
    # Check if fromCenterToEndNodeEdges can be sorted in plan
    testIfPtsAreInPlan = []
    for i in range(len(fromCenterToEndNodeEdges)):
        testIfPtsAreInPlan.append(fromCenterToEndNodeEdges[i].PointAtNormalizedLength(0.1))
        testIfPtsAreInPlan.append(fromCenterToEndNodeEdges[i].PointAtNormalizedLength(0.0))
    fitPlane = rg.Plane.FitPlaneToPoints(testIfPtsAreInPlan)[1]
    fitPlane.Translate(rg.Point3d.Subtract(Nodes[item], fitPlane.Origin))
    deviations = []
    for pt in testIfPtsAreInPlan:
        d = fitPlane.DistanceTo(pt)
        deviations.append(abs(d))
    maxDeviation = max(deviations) # Global indicator for planarity
    
    ##----------------------------------------------------------------------------------------------------
    ## Collects all fillets here.
    Fillet = []
    ProjectedFillet = []
    AngleEdges = []
    
    ##----------------------------------------------------------------------------------------------------
    ## 2DX-NODE.
    print maxDeviation
    if maxDeviation < 0.2: # Creates a 2DX-Nodes (Meaning it can be solved in plan)
        NodeType = '2DX-Node'
        
        fromCenterToEndNodeEdges_SortedAlongCircle = Pynet.GeoUtils.sortsRadialSegmentsAlongCircle(fitPlane, fromCenterToEndNodeEdges)[1]
        fromCenterToEndNodeEdges_SortedAlongCircle_Shifted = fromCenterToEndNodeEdges_SortedAlongCircle[1:] + fromCenterToEndNodeEdges_SortedAlongCircle[:1]
        
        # Gets angle edges
        PtCloud = rg.PointCloud()
        for i in range(len(fromCenterToEndNodeEdges_SortedAlongCircle)):
            PtCloud.Add(fromCenterToEndNodeEdges[i].PointAtNormalizedLength(t))
            AngleEdges0 = fromCenterToEndNodeEdges_SortedAlongCircle[i]
            AngleEdges1 = fromCenterToEndNodeEdges_SortedAlongCircle_Shifted[i]
            AngleEdges0.Domain = rg.Interval(0,1)
            AngleEdges1.Domain = rg.Interval(0,1)
            TrimAngleEdges0 = AngleEdges0.Trim(0,t)
            TrimAngleEdges1 = AngleEdges1.Trim(0,t)
            TrimAngleEdges0.Reverse()
            TrimAngleEdges1.Reverse()
            AngleEdges.append([TrimAngleEdges0, TrimAngleEdges1])
        
        # Checks the angle between the edges
        for i in range(len(AngleEdges)):
            stPt0 = AngleEdges[i][0].PointAtNormalizedLength(0.0)
            enPt0 = AngleEdges[i][0].PointAtNormalizedLength(1.0)
            stPt1 = AngleEdges[i][1].PointAtNormalizedLength(0.0)
            enPt1 = AngleEdges[i][1].PointAtNormalizedLength(1.0)
            Vec0 = rg.Point3d.Subtract(stPt0, enPt0)
            Vec1 = rg.Point3d.Subtract(stPt1, enPt1)
            AnglesDegree = m.degrees(rg.Vector3d.VectorAngle(Vec0, Vec1, fitPlane))

            if AnglesDegree < 200: # Gets largest fillet between the two edges
                Fillet.append(Pynet.GeoUtils.GetLargestFilletBetweenTwoCurves(AngleEdges[i])[0])
                
            elif len(AngleEdges) > 2:
                Origins = []
                CtrlPts = []
                TrimmedCurves = []
                for j in range(len(AngleEdges[i])):
                    Crv = AngleEdges[i][j]
                    Crv.Domain = rg.Interval(0,1)
                    Param = Crv.ClosestPoint(Crv.PointAtLength(Crv.GetLength()-1.2))[1]
                    ZVec = Crv.FrameAt(Param)[1].XAxis
                    Dis = Crv.PointAtNormalizedLength(Param).DistanceTo(Crv.PointAtNormalizedLength(1))
                    
                    Origin = Crv.FrameAt(Param)[1].Origin
                    Origins.append(Origin)
                    CtrlPt = deepcopy(Origin)
                    
                    TrimmedCrv = Crv.Trim(0,Param)
                    TrimmedCurves.append(TrimmedCrv)
                    ZVec = rg.Vector3d.Multiply(Dis/2,ZVec)
                    Translation = rg.Transform.Translation(ZVec)
                    transCtrlPt = CtrlPt.Transform(Translation)
                    CtrlPts.append(CtrlPt)

                Crvs = rg.NurbsCurve.Create(False, 2,[Origins[0], CtrlPts[0], CtrlPts[1], Origins[1]])
                PolyCrv = rg.Curve.JoinCurves([TrimmedCurves[0],Crvs,TrimmedCurves[1]])[0]
                Fillet.append(PolyCrv)
                
    ##----------------------------------------------------------------------------------------------------
    ### 3DX-NODE. ###
    
    else:
        NodeType = '3DX-Node'
        
        # Creates a convex hull
        PointsForConvexHull = []
        Node = Nodes[item]
        PointsForConvexHull.append(Node)
        for i in range(len(fromCenterToEndNodeEdges)):
            miPt = fromCenterToEndNodeEdges[i].PointAtNormalizedLength(t)
            PointsForConvexHull.append(miPt)
        CHullMesh = Pynet.GeoUtils.ConvexHull3D(PointsForConvexHull)
        
        #Extract vertices and edges from convex hull
        MeshVertices = rg.Mesh.Vertices.GetValue(CHullMesh).ToPoint3dArray()
        MeshEdges = []
        TE = CHullMesh.TopologyEdges
        for i in range(TE.Count):
            MeshEdges.append(TE.EdgeLine(i))
        
        # Gets "Naked Edges" from 3D Convex Hull
        ClosestIndex = rg.PointCloud.ClosestPoint(rg.PointCloud(MeshVertices),Node)
        ClosestDistance = rg.Point3d.DistanceTo(Node, MeshVertices[ClosestIndex])
        if ClosestDistance < 0.1:
            nakedEdges = []
            boolStart = []
            boolEnd = []
            for i in range(len(MeshEdges)):
                if MeshEdges[i].ToNurbsCurve().PointAtStart == MeshVertices[ClosestIndex]:
                    boolStart.append(True)
                else:
                    boolStart.append(False)
                if MeshEdges[i].ToNurbsCurve().PointAtEnd == MeshVertices[ClosestIndex]:
                    boolEnd.append(True)
                else:
                    boolEnd.append(False)
                if boolStart[i] + boolEnd[i] == 0:
                    nakedEdges.append(MeshEdges[i])
        else:
            nakedEdges = MeshEdges
        
        # Gets angle edges
        PtCloud = rg.PointCloud()
        for i in range(len(fromCenterToEndNodeEdges)):
            PtCloud.Add(fromCenterToEndNodeEdges[i].PointAtNormalizedLength(t))
        for i in range(len(nakedEdges)):
            ptCloudPtFrom = PtCloud.GetPoints()[PtCloud.ClosestPoint(nakedEdges[i].From)]
            ptCloudPtTo = PtCloud.GetPoints()[PtCloud.ClosestPoint(nakedEdges[i].To)]
            Crvs1 = fromCenterToEndNodeEdges[PtCloud.ClosestPoint(nakedEdges[i].From)]
            Crvs2 = fromCenterToEndNodeEdges[PtCloud.ClosestPoint(nakedEdges[i].To)]
            Crvs1.Domain = rg.Interval(0,1)
            Crvs2.Domain = rg.Interval(0,1)
            TrimCrvs1 = Crvs1.Trim(0,t)
            TrimCrvs2 = Crvs2.Trim(0,t)
            TrimCrvs1.Reverse()
            TrimCrvs2.Reverse()
            AngleEdges.append([TrimCrvs1, TrimCrvs2])
            
        # Calculates all fillets
        for i in range(len(AngleEdges)):
            bool = []
            for j in range(len(AngleEdges[i])):
                stPt = AngleEdges[i][j].PointAtStart
                endPt = AngleEdges[i][j].PointAtEnd
                if abs(stPt.DistanceTo(endPt) - AngleEdges[i][j].GetLength()) < 0.000001 : # Analyzes if nurbs curve is line-like curve
                    bool.append(True)
                else:
                    bool.append(False)
            if sum(bool) == 2:
                Fillet.append(Pynet.GeoUtils.GetLargestFilletBetweenTwoCurves(AngleEdges[i])[0])
            else:
                Origins = []
                CtrlPts = []
                Frames = []
                for j in range(len(AngleEdges[i])):
                    Crv = AngleEdges[i][j]
                    Crv.Domain = rg.Interval(0,1)
                    Frames.append(Crv.FrameAt(0)[1])
                    ZVec = Crv.FrameAt(0)[1].XAxis
                    Dis = Crv.PointAtNormalizedLength(0).DistanceTo(Crv.PointAtNormalizedLength(1))
                    Origin = Crv.FrameAt(0)[1].Origin
                    Origins.append(Origin)
                    CtrlPt = deepcopy(Origin)
                    ZVec.Unitize()
                    ZVec = rg.Vector3d.Multiply(Dis/1.9,ZVec)
                    Translation = rg.Transform.Translation(ZVec)
                    transCtrlPt = CtrlPt.Transform(Translation)
                    CtrlPts.append(CtrlPt)
                Crvs = rg.NurbsCurve.Create(False, 2,[Origins[0], CtrlPts[0], CtrlPts[1], Origins[1]])
                Fillet.append(Crvs)
                
    if not SurfaceIndices: # If not MS, fillet = fillet
        ProjectedFillet.extend(Fillet)
    else: # If MS, then projects
        def ProjectFilletsToClosestSrf(Fillet, SrfIndex):
            ProjectedFillet = []
            closestSrf = SrfIndex
            for i in range(len(Fillet)):
                stPt = Fillet[i].PointAtStart
                enPt = Fillet[i].PointAtEnd
                stPtClosest = Pynet.GeoUtils.ClosestPtOnSurface(stPt,closestSrf)
                enPtClosest = Pynet.GeoUtils.ClosestPtOnSurface(enPt,closestSrf)
                stDis = stPt.DistanceTo(stPtClosest)
                enDis = enPt.DistanceTo(enPtClosest)
                if stDis < 0.05 and enDis < 0.05:
                    ProjectedFillet.append(Pynet.GeoUtils.ClosestPolylinesToSurface([Fillet[i]],closestSrf,50)[0])
                else:
                    ProjectedFillet.append(Fillet[i])
                    
            return ProjectedFillet
        ProjectedFillet.extend(ProjectFilletsToClosestSrf(Fillet, MS[SurfaceGlobalIndex]))
    
    Rails = ProjectedFillet
    
    ##----------------------------------------------------------------------------------------------------
    ### Generation of Sections. ###
    
    if GenerateGeometry == False:
        pass
        
    else:
        
        ##----------------------------------------------------------------------------------------------------
        
        if len(NodeNeighborsIndices) == 2: # Generates the profiles in the case of a node with two valencies
            stPerpFrames = []
            stPerpFramesOrigins = []
            AngleEdges[0][0].Domain = rg.Interval(0,1)
            AngleEdges[0][1].Domain = rg.Interval(0,1)
            stPerpFrames.append(AngleEdges[0][0].PerpendicularFrameAt(0)[1])
            stPerpFrames.append(AngleEdges[0][1].PerpendicularFrameAt(0)[1])
            stPerpFramesOrigins.append(AngleEdges[0][0].PerpendicularFrameAt(0)[1].Origin)
            stPerpFramesOrigins.append(AngleEdges[0][1].PerpendicularFrameAt(0)[1].Origin)
            
            ClosestEdgesIndex = []
            for i in range(len(stPerpFramesOrigins)):
                ClosestEdgesIndex.append(PtCloud.ClosestPoint(stPerpFramesOrigins[i]))
            stPerpFramesOriented = []
            
            # Orients the planes if the corresponding edge is based on a master surface or not
            for i in range(len(ClosestEdgesIndex)):
                if 'isolated' in Graph[item].values()[ClosestEdgesIndex[i]]:
                    stPerpFramesOriented.append(stPerpFrames[i])
                elif 'surfaceTouch' in Graph[item].values()[ClosestEdgesIndex[i]]:
                    stPerpFramesOriented.append(stPerpFrames[i])
                elif 'surfaceBased' in Graph[item].values()[ClosestEdgesIndex[i]]:
                    MasterSrf = MS[Graph[item].values()[ClosestEdgesIndex[i]].values()[0]]
                    UV = MasterSrf.ClosestPoint(stPerpFramesOrigins[i])
                    SrfFrame = MasterSrf.FrameAt(UV[1], UV[2])[1]
                    SrfFrameO = SrfFrame.Origin
                    SrfFrameZ = SrfFrame.ZAxis
                    stPerpFramesOriented.append(rg.Plane(SrfFrameO, SrfFrameZ, stPerpFrames[i].XAxis))
                    
            # Create Boundary Profiles
            Profiles = Pynet.GeoUtils.RectanglesFromPlanesOrigins(stPerpFramesOriented, ProfileThickness, True, fillet)
            
        ##----------------------------------------------------------------------------------------------------
        
        else: # Generates the profiles in the case of a node with MORE than two valencies
            
            # Project fillets onto perpendicular frames
            ProjectedSegments = []
            stPerpFrames = []
            stPerpFramesOrigins = []
            for i in range(len(AngleEdges)):
                for j in range(len(AngleEdges[i])):
                    AngleEdges[i][j].Domain = rg.Interval(0,1)
                    stPerpFrame = AngleEdges[i][j].PerpendicularFrameAt(0)[1]
                    stPerpFrames.append(stPerpFrame)
                    stPerpFramesOrigins.append(stPerpFrame.Origin)
                    if NodeType == '3DX-Node' or NodeType == '2DX-Node':
                        ProjectedCrv = rg.Curve.ProjectToPlane(ProjectedFillet[i], stPerpFrame)
                        stPt = ProjectedCrv.PointAtStart
                        enPt = ProjectedCrv.PointAtEnd
                    if stPt.DistanceTo(stPerpFrame.Origin) > 0.1:
                        ProjectedCrv.Reverse()
                    ProjectedSegments.append(Pynet.GeoUtils.Scale_Linelike_Curve(ProjectedCrv,1).ToNurbsCurve())
            
            # Re-orient planes if a master surface exists
            ClosestEdgesIndex = []
            for i in range(len(stPerpFramesOrigins)):
                ClosestEdgesIndex.append(PtCloud.ClosestPoint(stPerpFramesOrigins[i]))
            stPerpFramesOriented = []
            for i in range(len(ClosestEdgesIndex)):
                if 'isolated' in Graph[item].values()[ClosestEdgesIndex[i]] or 'surfaceTouch' in Graph[item].values()[ClosestEdgesIndex[i]]:
                    stPerpFramesOriented.append(stPerpFrames[i])
                elif 'surfaceBased' in Graph[item].values()[ClosestEdgesIndex[i]]:
                    MasterSrf = MS[Graph[item].values()[ClosestEdgesIndex[i]].values()[0]]
                    UV = MasterSrf.ClosestPoint(stPerpFramesOrigins[i])
                    SrfFrame = MasterSrf.FrameAt(UV[1], UV[2])[1]
                    SrfFrameO = SrfFrame.Origin
                    SrfFrameZ = SrfFrame.ZAxis
                    stPerpFramesOriented.append(rg.Plane(SrfFrameO, SrfFrameZ, stPerpFrames[i].XAxis))
            print NodeType
            if NodeType == '3DX-Node':
                pass
            else:
                del ProjectedSegments[:]
                
                split2DPlanes = []
                #ProjectedSegments = []
                print len(stPerpFramesOriented)
                for i in range(len(stPerpFramesOriented)):
                    
                    split2DPlane = rg.Plane(stPerpFramesOriented[i].Origin, fitPlane.XAxis, fitPlane.YAxis)
                    split2DPlaneZAxis = split2DPlane.ZAxis
                    split2DPlanes.append(split2DPlane)
                MasterSrfFrames = []
                LinePoss = []
                for i in range(len(split2DPlanes)):
   
                    if i%2 == 0:
                        Trans = rg.Transform.Translation(split2DPlanes[i].ZAxis)
                    else:
                        Trans = rg.Transform.Translation(-split2DPlanes[i].ZAxis)
                        
                    Origin = stPerpFramesOriented[i].Origin
                    TransZOrigin = deepcopy(Origin)
                    TransZOrigin.Transform(Trans)
                    LinePos = rg.Line(Origin, TransZOrigin).ToNurbsCurve()
                    LinePos.Domain = rg.Interval(0,1)
                    LinePoss.append(LinePos)
                    
                for i in range(len(LinePoss)):
                    ProjectedSegments.append(
                    rg.Curve.ProjectToPlane(LinePoss[i], stPerpFramesOriented[i]))
                    
                for i in range(len(ProjectedSegments)):
                    TransToCenterPos = rg.Transform.Translation(stPerpFramesOriented[i].ZAxis)
                    TestPtToCenterPos = stPerpFramesOriented[i].Origin
                    TestPtToCenterPos.Transform(TransToCenterPos)
                    TransToCenterNeg = rg.Transform.Translation(-stPerpFramesOriented[i].ZAxis)
                    TestPtToCenterNeg = stPerpFramesOriented[i].Origin
                    TestPtToCenterNeg.Transform(TransToCenterNeg)
                    if TestPtToCenterPos.DistanceTo(Nodes[item]) > TestPtToCenterNeg.DistanceTo(Nodes[item]):
                        TransRot = rg.Transform.Rotation(-m.pi/2, stPerpFramesOriented[i].ZAxis, stPerpFramesOriented[i].Origin)
                    else:
                        TransRot = rg.Transform.Rotation(m.pi/2, stPerpFramesOriented[i].ZAxis, stPerpFramesOriented[i].Origin)
                    ProjectedSegments[i].Transform(TransRot)
                
            
            ##----------------------------------------------------------------------------------------------------
            
            # Group by proximity
            ClusterPts = Pynet.GeoUtils.createPtCloudFromPoints(stPerpFramesOrigins, 0.001).GetPoints()
            Spheres = []
            for i in range(len(ClusterPts)):
                Spheres.append(rg.Sphere(ClusterPts[i], 0.2))
            Keys = ghcomp.PointInBreps(Spheres,stPerpFramesOrigins,True)[1]
            crvGroups = Pynet.ListUtils.SortAndGroupValuesWithKeys(Keys, ProjectedSegments)[0]
            planeGroups = Pynet.ListUtils.SortAndGroupValuesWithKeys(Keys, stPerpFramesOriented)[0]
            indicesGroups = Pynet.ListUtils.SortAndGroupValuesWithKeys(Keys, ProjectedSegments)[1]
            
            # Sorts along each circle
            crvGroups_SortedAlongCircle = []
            crvGroups_SortedAlongCircle_Shifted = []
            srtAlongCirc_indices_NestedList = []
            for i in range(len(crvGroups)):
                srtAlongCirc = Pynet.GeoUtils.sortsRadialSegmentsAlongCircle(planeGroups[i][0], crvGroups[i])[1]
                srtAlongCirc_indices = Pynet.GeoUtils.sortsRadialSegmentsAlongCircle(planeGroups[i][0], crvGroups[i])[2]
                srtAlongCirc_indices_NestedList.append(srtAlongCirc_indices[1:] + srtAlongCirc_indices[:1])
                crvGroups_SortedAlongCircle.append(srtAlongCirc)
                crvGroups_SortedAlongCircle_Shifted.append(srtAlongCirc[1:] + srtAlongCirc[:1])
            
            # Creates bisectors
            Bisectors = []
            for i in range(len(crvGroups_SortedAlongCircle)):
                a = []
                for j in range(len(crvGroups_SortedAlongCircle[i])):
                    Vec1 = rg.Point3d.Subtract(crvGroups_SortedAlongCircle[i][j].PointAtEnd, crvGroups_SortedAlongCircle[i][j].PointAtStart)
                    Vec2 = rg.Point3d.Subtract(crvGroups_SortedAlongCircle_Shifted[i][j].PointAtEnd, crvGroups_SortedAlongCircle_Shifted[i][j].PointAtStart)
                    VecAngle = rg.Vector3d.VectorAngle(Vec1, Vec2, planeGroups[i][j])
                    RotatedCrv = deepcopy(crvGroups_SortedAlongCircle[i][j])
                    RotatedCrv.Rotate(VecAngle/2, planeGroups[i][0].ZAxis, planeGroups[i][0].Origin)
                    a.append(RotatedCrv)
                Bisectors.append(a)
            
            
            ScaledBisectors = []
            for i in range(len(Bisectors)):
                a = []
                for j in range(len(Bisectors[i])):
                    #LineBisectors = rg.Line(Bisectors[i][j].PointAtNormalizedLength(0.0), Bisectors[i][j].PointAtNormalizedLength(1.0))
                    a.append(Pynet.GeoUtils.Scale_Linelike_Curve(Bisectors[i][j],50))
                ScaledBisectors.append(a)
                
            
            #Create Boundary Profiles
            planeGroups0 = []
            for i in range(len(planeGroups)):
                planeGroups0.append(planeGroups[i][0])
            Profiles = Pynet.GeoUtils.RectanglesFromPlanesOrigins(planeGroups0, ProfileThickness, True, fillet)
            
            ##----------------------------------------------------------------------------------------------------
            
            # Generates parameters for trim
            PointsB_1 = []
            PointsB_2 = []
            ParamTrimsList = []
            Bisectors_Shifted = []
            for i in range(len(Bisectors)):
                Bisectors_Shifted.append(Bisectors[i][1:] + Bisectors[i][:1])
                ParamTrims_List = []
                a = []
                b = []
                c = []
                for j in range(len(Bisectors[i])):
                    PointB_1 = rg.Intersect.Intersection.CurveCurve(Bisectors[i][j], Profiles[i], 0.1, 0.1)[0].PointB
                    PointB_2 = rg.Intersect.Intersection.CurveCurve(Bisectors_Shifted[i][j], Profiles[i], 0.1, 0.1)[0].PointB
                    a.append(PointB_1)
                    b.append(PointB_2)
                    ParamTrimB_1 = rg.Intersect.Intersection.CurveCurve(Bisectors[i][j], Profiles[i], 0.1, 0.1)[0].ParameterB
                    ParamTrimB_2 = rg.Intersect.Intersection.CurveCurve(Bisectors_Shifted[i][j], Profiles[i], 0.1, 0.1)[0].ParameterB
                    ParamTrims = [ParamTrimB_1, ParamTrimB_2]
                    c.append(ParamTrims)
                PointsB_1.append(a)
                PointsB_2.append(b)
                ParamTrimsList.append(c)
            
            # Generates sections
            TrimmedCrvs = []
            ProfileLines1 = []
            ProfileLines2 = []
            for i in range(len(ParamTrimsList)):
                a = []
                for j in range(len(ParamTrimsList[i])):
                    TrimmedCrv = Profiles[i].Trim(ParamTrimsList[i][j][0], ParamTrimsList[i][j][1])
                    listParams = TrimmedCrv.DivideByLength(0.02, True)
                    listPts = []
                    for k in range(len(listParams)):
                        listPts.append(TrimmedCrv.PointAtNormalizedLength(listParams[k]))
                    ListPts = []
                    ArrayPts = TrimmedCrv.DivideEquidistant(0.02)
                    for k in range(len(ArrayPts)):
                        ListPts.append(ArrayPts[k])
                    ListPts.append(TrimmedCrv.PointAtNormalizedLength(1.0))
                    TrimmedCrv = rg.NurbsCurve.Create(False,3,ListPts)
                    a.append(TrimmedCrv)
                TrimmedCrvs.append(a)
            for i in range(len(planeGroups)):
                a = []
                b = []
                for j in range(len(planeGroups[i])):
                    a.append(rg.Line(planeGroups[i][0].Origin, PointsB_1[i][j]))
                    b.append(rg.Line(planeGroups[i][0].Origin, PointsB_2[i][j]))
                ProfileLines1.append(a)
                ProfileLines2.append(b)
                
            ##----------------------------------------------------------------------------------------------------
            ## Joins generated profiles
            InnerSections = []
            for i in range(len(ProfileLines1)):
                a = []
                for j in range(len(ProfileLines1[i])):
                    a.append(ghcomp.JoinCurves([ProfileLines1[i][j].ToNurbsCurve(), ProfileLines2[i][j].ToNurbsCurve()]).ToNurbsCurve())
                InnerSections.append(a)
            
            # "BackSort" data
            def BackSortData(ListCrvs, srtAlongCirc_indices_NestedList, indicesGroups):
                ListCrvs_Sorted = []
                for i in range(len(ListCrvs)):
                    ListCrvs_Sorted.append(Pynet.ListUtils.sortListKeysWithListValues(srtAlongCirc_indices_NestedList[i], ListCrvs[i])[1])
                ListCrvs_Sorted_Flatten = Pynet.ListUtils.flattenNestedList(ListCrvs_Sorted)
                BackSortedListCrvs = Pynet.ListUtils.sortListKeysWithListValues(indicesGroups, ListCrvs_Sorted_Flatten)[1]
                return BackSortedListCrvs
            InnerSections_BackSorted = BackSortData(InnerSections, srtAlongCirc_indices_NestedList, indicesGroups)
            OuterSections_BackSorted = BackSortData(TrimmedCrvs, srtAlongCirc_indices_NestedList, indicesGroups)
            
        def FlipSameDirection(ChunkSections):
            import math as m
            a = []
            if ChunkSections[0].ToNurbsCurve().IsClosed == True: # If the sections are closed, re-seam the curves according to their closest point proximity.
                ptA = ghcomp.CurveProximity(ChunkSections[0], ChunkSections[1])[0]
                ptB = ghcomp.CurveProximity(ChunkSections[0], ChunkSections[1])[1]
                paramA = ChunkSections[0].ClosestPoint(ptA)[1]
                paramB = ChunkSections[1].ClosestPoint(ptB)[1]
                adjustedCrv0 = ghcomp.Seam(ChunkSections[0], paramA)
                adjustedCrv1 = ghcomp.Seam(ChunkSections[1], paramB)
                angleSeam = m.degrees(rg.Vector3d.VectorAngle(adjustedCrv0.TangentAt(0), adjustedCrv1.TangentAt(0)))
                if angleSeam > 90:
                    adjustedCrv0.Reverse()
                else:
                    pass
                a.append(adjustedCrv0)
                a.append(adjustedCrv1)
                return a
            else:
                ChunkSections0 = ChunkSections[0].ToNurbsCurve()
                ChunkSections1 = ChunkSections[1].ToNurbsCurve()
                stPt0 = ChunkSections0.PointAtNormalizedLength(0.0)
                enPt0 = ChunkSections0.PointAtNormalizedLength(1.0)
                stPt1 = ChunkSections1.PointAtNormalizedLength(0.0)
                enPt1 = ChunkSections1.PointAtNormalizedLength(1.0)
                testLine0 = rg.Line(stPt0, stPt1).ToNurbsCurve()
                testLine1 = rg.Line(enPt0, enPt1).ToNurbsCurve()
                testPlane = rg.Plane(stPt0, enPt0, stPt1)
                testProjLine0 = rg.Curve.ProjectToPlane(testLine0, testPlane)
                testProjLine1 = rg.Curve.ProjectToPlane(testLine1, testPlane)
                testIntersectEvent = rg.Intersect.Intersection.CurveCurve(testProjLine0, testProjLine1, 0.1, 0.1)
                
                if len(testIntersectEvent) == 0:
                    pass
                else:
                    ChunkSections1.Reverse()
                a.append(ChunkSections0)
                a.append(ChunkSections1)
                return a
                
        if len(NodeNeighborsIndices) > 2:
            
            Inner_Sections = Pynet.ListUtils.chunksList(InnerSections_BackSorted,2)
            Flipped_Inner_Sections = []
            for i in range(len(Inner_Sections)):
                Flipped_Inner_Sections.append(FlipSameDirection(Inner_Sections[i]))
                
            Outer_Sections = Pynet.ListUtils.chunksList(OuterSections_BackSorted,2)
            Flipped_Outer_Sections = []
            for i in range(len(Outer_Sections)):
                Flipped_Outer_Sections.append(FlipSameDirection(Outer_Sections[i]))
            
        else:
            
            Flipped_Inner_Sections = None
            
            Outer_Sections = Pynet.ListUtils.chunksList(Profiles,2)
            Flipped_Outer_Sections = []
            for i in range(len(Outer_Sections)):
                Flipped_Outer_Sections.append(FlipSameDirection(Outer_Sections[i]))
        
        Sections_In = Flipped_Inner_Sections
        Sections_Ext = Flipped_Outer_Sections
        
        
        if len(NodeNeighborsIndices) > 2:
            Sections = []
            for i in range(len(Sections_In)):
                a = []
                for j in range(len(Sections_In[i])):
                    a.append(rg.Curve.JoinCurves([Sections_In[i][j], Sections_Ext[i][j]])[0])
                Sections.append(a)
        else:
            Sections = Sections_Ext
# ---------- end python_17 ----------
lng = ListLength(List=divlength.Points)  # -> flatten(Length)
lng_2 = ListLength(List=divlength_2.Points)  # -> flatten(Length)
python_18 = PythonScript(
    GenerateBeams=generatebeams,
    Rail_Oriented=python_15.Edges_SrfBased_Trimmed,
    Sections_Oriented=python_15.ListProfiles_SrfBased,
    Subdivision_U=lng_2,
    Subdivision_V=number_slider_2)  # -> out, Mesh_Oriented; inputs GenerateBeams: Boolean, Rail_Oriented: Curve, Subdivision_U: Int32, Subdivision_V: Int32
# ---------- python_18: Python ----------
##----------------------------------------------------------------------------------------------------
## Import internal libraries
import Rhino.Geometry as rg
import rhinoscriptsyntax as rs
from scriptcontext import sticky as st
from ghpythonlib import components as ghcomp
from copy import deepcopy
import math as m

## Import external libraries
import networkx as nx
import Pynet

##----------------------------------------------------------------------------------------------------
if GenerateBeams:
    Mesh_Oriented = Pynet.GeoUtils.SweepOneRail_QuadMesh(Sections_Oriented, Rail_Oriented,  Subdivision_U, Subdivision_V, 0)
# ---------- end python_18 ----------
python_19 = PythonScript(
    GenerateBeams=generatebeams,
    Rail=python_15.Edges_SrfTouch_Trimmed,
    Sections=python_15.ListProfiles,
    Subdivision_U=lng,
    Subdivision_V=number_slider_2)  # -> out, Mesh; inputs GenerateBeams: Boolean, Rail: Curve, Subdivision_U: Int32, Subdivision_V: Int32
# ---------- python_19: Python ----------
##----------------------------------------------------------------------------------------------------
## Import internal libraries
import Rhino.Geometry as rg
import rhinoscriptsyntax as rs
from scriptcontext import sticky as st
from ghpythonlib import components as ghcomp
from copy import deepcopy
import math as m

## Import external libraries
import networkx as nx
import Pynet

##----------------------------------------------------------------------------------------------------
if GenerateBeams:
    Mesh = Pynet.GeoUtils.SweepOneRail_QuadMesh(Sections, Rail,  Subdivision_U, Subdivision_V, 0)
# ---------- end python_19 ----------
python_20 = PythonScript(x=python_17.Sections)  # -> simplify(a); same code as python

profiles = BooleanToggle(False)
mesh_3 = BooleanToggle(True)
brep = BooleanToggle(True)

python_21 = PythonScript(Mesh=mesh_3, Brep=brep, Profiles=profiles)  # -> GeoFilter; inputs Mesh: Boolean, Brep: Boolean, Profiles: Boolean
# ---------- python_21: Python ----------
GeoFilter = []
if Mesh == True: GeoFilter.append(0)
if Brep == True: GeoFilter.append(1)
if Profiles == True: GeoFilter.append(2)
# ---------- end python_21 ----------

subdivision_v = Slider(7, range=2..100)
subdivision_u_2 = Slider(14, range=2..100)

mesh_4 = Mesh([python_18.Mesh_Oriented, python_19.Mesh])
previewsupports = BooleanToggle(False)
python_22 = PythonScript(AN=python_5.newEdges)  # -> L; inputs AN: list of Curve
# ---------- python_22: Python ----------
import Rhino.Geometry as rg

#Abstract Network to analyse
L = [rg.Line(Crvs.PointAtStart, Crvs.PointAtEnd).ToNurbsCurve() for Crvs in [Crvs.ToNurbsCurve() for Crvs in AN]]
# ---------- end python_22 ----------
data_2 = Data(profilethickness)
area = Area(Geometry=mesh_4)  # -> Area, Centroid
python_23 = PythonScript(
    GeometryGeneration=python_21,
    Subdivision_U=subdivision_u_2,
    Subdivision_V=subdivision_v,
    Sections=python_20,
    Rails=python_17.Rails)  # -> out, simplify(Mesh), simplify(Surface), Profiles; inputs GeometryGeneration: list of Int32, Subdivision_U: Int32, Subdivision_V: Int32, Sections: list of Curve, Rails: Curve
# ---------- python_23: Python ----------
import Pynet
import Rhino.Geometry as rg
from copy import deepcopy
import copy
from ghpythonlib import components as ghcomp

        
def SweepOneRail_QuadMesh(Sections, Rail,  Subdivision_U, Subdivision_V, GeometryGeneration):

    """ 
    Author: Paul Poinet / 18.08.2016
    Description: SweepOneRail with Quad-Mesh option.
    Inputs:
        List of two sections
        One rail
    Outputs:
        Quad-Mesh (0), Surface (1) and Profile sections (2)
    """
    import Rhino.Geometry as rg


    # Reverse rail in order to preserve the right order of the cross sections along the rail.
    DisStart = rg.Point3d.DistanceTo(Rail.PointAtStart, Sections[0].PointAtNormalizedLength(0.5))
    DisEnd = rg.Point3d.DistanceTo(Rail.PointAtEnd, Sections[0].PointAtNormalizedLength(0.5))
    if DisStart < DisEnd:
        pass
    else:
        Rail.Reverse()
    Rail.Domain = rg.Interval(0,1)

    # Creates a series corresponding to the number of interpolated planes.
    Series = []
    for i in range(Subdivision_U):
        Series.append(i)
    remapSeries = []
    for i in range(len(Series)):
        newValues = float(float(Series[i]) / float(Series[-1]))
        remapSeries.append(newValues)

    # Creates perpendicular frames along the curve
    PerpFrames = []
    for t in remapSeries:
        PerpFrames.append(Rail.PerpendicularFrameAt(t)[1])

    # Projects the sections on WorldXY.
    Transformation0 = rg.Transform.PlaneToPlane(PerpFrames[0], rg.Plane.WorldXY)
    Transformation1 = rg.Transform.PlaneToPlane(PerpFrames[-1], rg.Plane.WorldXY)
    Section0 = Sections[0]
    Section1 = Sections[1]
    Section0.Transform(Transformation0)
    Section1.Transform(Transformation1)

    # Creates interpolated profiles.
    
    if len(ghcomp.Explode(Section0, True)[0]) > 5:
        Segments_Section0 = [Section0]
        Segments_Section1 = [Section1]
    else:
        Segments_Section0 = ghcomp.Explode(Section0, True)[0]
        Segments_Section1 = ghcomp.Explode(Section1, True)[0]
        
    
    def SubdivPointsForInterpolation_Surface(Segments_Section, Subdiv_Res):
        PointsForProfilesInterpolations = []
        for i in range(len(Segments_Section)):
            if type(Segments_Section[i]) == rg.LineCurve:
                PointsForProfilesInterpolations.append(Pynet.GeoUtils.DivideByCount_GetPoints(Segments_Section[i].ToNurbsCurve(), 1))
            else:
                PointsForProfilesInterpolations.append(Pynet.GeoUtils.DivideByCount_GetPoints(Segments_Section[i].ToNurbsCurve(), Subdiv_Res))
        return PointsForProfilesInterpolations
    subDivSection0_ForSurface = SubdivPointsForInterpolation_Surface(Segments_Section0, 50)
    subDivSection1_ForSurface = SubdivPointsForInterpolation_Surface(Segments_Section1, 50)
    def GetLinesForInterpolation(subDivSection0, subDivSection1):
        LinesForInterpolation = []
        for i in range(len(subDivSection0)):
            a = []
            for j in range(len(subDivSection0[i])):
                a.append(rg.Line(subDivSection0[i][j], subDivSection1[i][j]).ToNurbsCurve())
            LinesForInterpolation.append(a)
        return LinesForInterpolation
    LinesForInterpolation_Surface = GetLinesForInterpolation(subDivSection0_ForSurface, subDivSection1_ForSurface)
    def GetPointsForInterpolation(LinesForInterpolation):
        LinesForInterpolation_Flatten = Pynet.ListUtils.flattenNestedList(LinesForInterpolation_Surface)
        PointsForInterpolation = []
        for i in range(len(LinesForInterpolation_Flatten)):
            a = []
            for j in range(len(remapSeries)):
                a.append(LinesForInterpolation_Flatten[i].PointAtNormalizedLength(remapSeries[j]))
            PointsForInterpolation.append(a)
        PointsForInterpolation_flipMatrix = map(list, zip(*PointsForInterpolation))
        return PointsForInterpolation_flipMatrix
    PointsForInterpolation_Surface = GetPointsForInterpolation(LinesForInterpolation_Surface)
    def GetProfilesSweep(InterpolatedCurves):
            ProfilesSweep = []
            for i in range(len(InterpolatedCurves)):
                BackToLocalCoordinates = rg.Transform.PlaneToPlane(rg.Plane.WorldXY, PerpFrames[i])
                CurvesToMap = InterpolatedCurves[i]
                CurvesToMap.Transform(BackToLocalCoordinates)
                ProfilesSweep.append(CurvesToMap)
            return ProfilesSweep
    
    
    
    
    if len(ghcomp.Explode(Section0, True)[0]) > 5:
        if 1 in GeometryGeneration or 2 in GeometryGeneration:
            
            def GetInterpolatedCurves(PointsForInterpolation):
                InterpolatedCurves = []
                for i in range(len(PointsForInterpolation)):
                    InterpolatedCurves.append(rg.NurbsCurve.Create(True, 3, PointsForInterpolation[i]))
                return InterpolatedCurves
            InterpolatedCurves_Surface = GetInterpolatedCurves(PointsForInterpolation_Surface)
            ProfilesSweep_Surface = GetProfilesSweep(InterpolatedCurves_Surface)
        else:
            ProfilesSweep_Surface = None
            
    else:
        if 1 in GeometryGeneration or 2 in GeometryGeneration:
            InterpolatedCurves_Surface_0 = []
            InterpolatedCurves_Surface_1 = []
            InterpolatedCurves_Surface_2 = []
            PointsForNurbs = []
            for i in range(len(PointsForInterpolation_Surface)):
                InterpolatedCurves_Surface_0.append(rg.Line(PointsForInterpolation_Surface[i][0], PointsForInterpolation_Surface[i][1]))
                InterpolatedCurves_Surface_1.append(rg.Line(PointsForInterpolation_Surface[i][2], PointsForInterpolation_Surface[i][3]))
                a = []
                for j in range(len(PointsForInterpolation_Surface[i])):
                    if j > 3:
                        a.append(PointsForInterpolation_Surface[i][j])
                PointsForNurbs.append(a)
            for i in range(len(PointsForNurbs)):
                InterpolatedCurves_Surface_2.append(rg.NurbsCurve.Create(False, 3, PointsForNurbs[i]))
            InterpolatedPolyCurve_Surface = []
            for i in range(len(InterpolatedCurves_Surface_0)):
                InterpolatedPolyCurve_Surface.append(ghcomp.JoinCurves([InterpolatedCurves_Surface_0[i], InterpolatedCurves_Surface_1[i], InterpolatedCurves_Surface_2[i]], True))
            
            ProfilesSweep_Surface = GetProfilesSweep(InterpolatedPolyCurve_Surface)
        else:
            ProfilesSweep_Surface = None
    
    
    OutputGeometries = []
    if 0 in GeometryGeneration:
        
        def SubdivPointsForInterpolation_Mesh(Segments_Section, Subdivision_V):
            AllPoints_Section = []
            for i in range(len(Segments_Section)):
                if type(Segments_Section[i]) == rg.LineCurve:
                    AllPoints_Section.append(Pynet.GeoUtils.DivideByCount_GetPoints(Segments_Section[i], 1))
                else:
                    AllPoints_Section.append(Pynet.GeoUtils.DivideByCount_GetPoints(Segments_Section[i], Subdivision_V))
            AllPoints_Section_Flatten = Pynet.ListUtils.flattenNestedList(AllPoints_Section)
            AllPoints_PtCloud_Section = Pynet.GeoUtils.createPtCloudFromPoints(AllPoints_Section_Flatten,0.000001)
            subDivSection = AllPoints_PtCloud_Section.GetPoints()
            return subDivSection
        if len(ghcomp.Explode(Section0, True)[0]) > 5:
            
            subDivSection0_ForMeshing = SubdivPointsForInterpolation_Mesh(Segments_Section0, Subdivision_V*2)
            subDivSection1_ForMeshing = SubdivPointsForInterpolation_Mesh(Segments_Section1, Subdivision_V*2)
        else:
            print Segments_Section0
            subDivSection0_ForMeshing = SubdivPointsForInterpolation_Mesh(Segments_Section0, Subdivision_V)
            subDivSection1_ForMeshing = SubdivPointsForInterpolation_Mesh(Segments_Section1, Subdivision_V)
    
        LinesForInterpolation = []
        for i in range(len(subDivSection0_ForMeshing)):
            LinesForInterpolation.append(rg.Line(subDivSection0_ForMeshing[i], subDivSection1_ForMeshing[i]).ToNurbsCurve())
            
        PointsForInterpolation = []
        for i in range(len(LinesForInterpolation)):
            a = []
            for j in range(len(remapSeries)):
                a.append(LinesForInterpolation[i].PointAtNormalizedLength(remapSeries[j]))
            PointsForInterpolation.append(a)
        PointsForInterpolation_flipMatrix = map(list, zip(*PointsForInterpolation))
    
        InterpolatedCurves = []
        for i in range(len(PointsForInterpolation_flipMatrix)):
            InterpolatedCurves.append(rg.Polyline(PointsForInterpolation_flipMatrix[i]))
        
        # Projects the curve profiles back to the generated perpendicular frames.
        ProfilesSweep = GetProfilesSweep(InterpolatedCurves)

        PointsOnProfiles = []
        for i in range(len(ProfilesSweep)):
            a = []
            for j in range(len(list(ProfilesSweep[i].X))):
                if list(ProfilesSweep[i].X)[j] == 0 and list(ProfilesSweep[i].Y)[j] == 0 and list(ProfilesSweep[i].Z)[j] == 0:
                    pass
                else:
                    a.append(rg.Point3d(list(ProfilesSweep[i].X)[j], list(ProfilesSweep[i].Y)[j], list(ProfilesSweep[i].Z)[j]))
            DivPoints = a
            PointsOnProfiles.append(DivPoints)
        
        
        MeshSweep = rg.Mesh()
        for i in range(len(PointsOnProfiles)-1):
            for j in range(len(PointsOnProfiles[i])):
                MeshSweep.Vertices.Add(PointsOnProfiles[i][j-1])
                MeshSweep.Vertices.Add(PointsOnProfiles[i][j])
                MeshSweep.Vertices.Add(PointsOnProfiles[i+1][j])
                MeshSweep.Vertices.Add(PointsOnProfiles[i+1][j-1])
        MeshSweepVertices = MeshSweep.Vertices.ToPoint3dArray()
        
        for i in range(len(MeshSweepVertices)):
            if i%4 == 0:
                MeshSweep.Faces.AddFace(i, i+1, i+2, i+3)
        MeshSweep.Normals.ComputeNormals()
        MeshSweep.Compact()
        #return MeshSweep
        OutputGeometries.append(MeshSweep)
        
    if 1 in GeometryGeneration: # Outputs Surface
        
        ProfilesSweepNurbs = []
        for i in range(len(ProfilesSweep_Surface)):
            ProfilesSweepNurbs.append(ProfilesSweep_Surface[i].ToNurbsCurve())
        
        SurfaceSweep = rg.Brep.CreateFromLoft(ProfilesSweepNurbs, rg.Point3d.Unset, rg.Point3d.Unset, rg.LoftType.Normal, False)
        if len(SurfaceSweep) == 1:
            OutputGeometries.append(SurfaceSweep[0])
        else:
            OutputGeometries.append(SurfaceSweep)
        
    if 2 in GeometryGeneration: # Outputs Profiles
        
        ProfilesSweepNurbs = []
        for i in range(len(ProfilesSweep_Surface)):
            ProfilesSweepNurbs.append(ProfilesSweep_Surface[i].ToNurbsCurve())
        OutputGeometries.append(ProfilesSweepNurbs)
        
    return OutputGeometries

# Generates sweeps
Geometry = []

if Rails is None:
    pass
if not Sections:
    pass
if Sections[0] is None:
    pass
else:
    Rails = rg.NurbsCurve.Create(False, 3, Pynet.GeoUtils.DivideByCount_GetPoints(Rails, 50))
    Geometry.append(SweepOneRail_QuadMesh(Sections, Rails, Subdivision_U, Subdivision_V, GeometryGeneration))

# Filters resulted geometries
Mesh = []
Surface = []
Profiles = []
for i in range(len(Geometry)):
    for j in range(len(Geometry[i])):
        if type(Geometry[i][j]) is rg.Mesh:
            Mesh.append(Geometry[i][j])
        if type(Geometry[i][j]) is rg.Brep:
            Surface.append(Geometry[i][j])
        if type(Geometry[i][j]) is list:
            Profiles.append(Geometry[i][j])
# ---------- end python_23 ----------

# ---- group: Global Structural Analysis
linetobeam = LineToBeamKaramba(Line=python_22, New=True, Remove=True, LimitDistance_m=0.005, BeamIdentifier="beams")  # -> flatten(Points), Element, Info
profile_thickness = Panel(data_2)
python_24 = PythonScript(ProfileThickness=profile_thickness)  # -> Widths, Thicks
# ---------- python_24: Python ----------
Widths = ProfileThickness*100*2
Thicks = ProfileThickness*100-0.1
# ---------- end python_24 ----------
fsim = FindSimilarMember(Data=python.Supports, Set=linetobeam.Points)  # -> Hit, Index
Z = UnitZ(Factor="-1")
cross_sections = CrossSectionsKaramba(
    ElementsIdentifiers="beams",
    Height_cm=python_24.Widths,
    UpperFlangeWidth_cm=python_24.Widths,
    LowerFlangeWidth_cm=python_24.Widths,
    UpperFlangeThickness_cm=python_24.Thicks,
    LowerFlangeThickness_cm=python_24.Thicks,
    SidewallsThickness_cm=python_24.Thicks,
    FilletRadius_cm=0.6,
    mode="Box")
matselect = MaterialSelectionKaramba(ElementsIdentifiers="beams", menu=[dropdown(3), dropdown(2)])
python_25 = PythonScript(PreviewSupports=previewsupports, Supports=fsim.Hit)  # inputs PreviewSupports: Boolean, Supports: list of Point3d
# ---------- python_25: Python ----------
import Rhino.Geometry as rg
import Grasshopper as gh
import Rhino as rc
import scriptcontext
from scriptcontext import sticky as st

def customDisplay(toggle,component):
    
    """ Make a custom display which is unique to the component and lives in sticky """
    
    # Make unique name and custom display
    displayGuid = "customDisplay_" + str(component.InstanceGuid)
    if displayGuid not in st:
        st[displayGuid] = rc.Display.CustomDisplay(True)
        
    # Clear display each time component runs
    st[displayGuid].Clear()
    
    # Return the display or get rid of it
    if toggle:
        return st[displayGuid]
    else:
        st[displayGuid].Dispose()
        del st[displayGuid]
        return None

color = rc.Display.ColorXYZ(1,0,0)
ps1 = rc.Display.PointStyle.Simple

dis = customDisplay(True, ghenv.Component)
if PreviewSupports == True:
    dis.AddPoints(Supports,color,ps1,25)
# ---------- end python_25 ----------
supp = SupportKaramba(PosInd=fsim.Hit, menu=[buttons(on, on, on, on, on, on)])
loads = LoadsKaramba(Vector=Z, LCase=0, mode="Gravity")
assemble = AssembleModelKaramba(
    Point=linetobeam.Points,
    Elem=linetobeam.Element,
    Support=supp,
    Load=loads,
    CrossSection=cross_sections,
    Material=matselect,
    LimitDistance_m=0.005)  # -> Model, Info, Mass_kg, CenterOfGravity
analyzethi = AnalyzeThIKaramba(Model=assemble.Model)  # -> CalculatedModel, MaximumDisplacement_m, ResultingForceOfGravity_kN, ElasticEnergy_kNm
analysisselection = Slider(0, range=0..5)
b_forces = BeamForcesKaramba(
    AnalyzedModel=analyzethi.CalculatedModel,
    BeamIdentifiers="beams",
    LCase=-1,
    MaximumDistanceBetweenResults_m=-1,
    NumberOfResultsPerBeamElement=2)  # -> AnalyzedModel, NormalForce_kN, ShearForceVz_kN, ShearForceVy_kN, BendingMomentMt_kNm, BendingMomentMy_kNm, BendingMomentMz_kNm
python_26 = PythonScript(
    G=analysisselection,
    N=b_forces.NormalForce_kN,
    Vz=b_forces.ShearForceVz_kN,
    Vy=b_forces.ShearForceVy_kN,
    Mt=b_forces.BendingMomentMt_kNm,
    My=b_forces.BendingMomentMy_kNm,
    Mz=b_forces.BendingMomentMz_kNm)  # -> out, AM_abs; inputs G: Int32, N: tree, Vz: tree, Vy: tree, Mt: tree, My: tree, Mz: tree
# ---------- python_26: Python ----------
# Average and gets absolute value

import Pynet

if G == 0:
    nList = Pynet.ListUtils.ghDataTreeToPythonList(N)
    AM_abs = [abs(sum(l)/len(l)) for l in nList]
    print 'Axial forces N [kN]'
    
if G == 1:
    nList = Pynet.ListUtils.ghDataTreeToPythonList(Vz)
    AM_abs = [abs(sum(l)/len(l)) for l in nList]
    print 'Shear force Vz [kN]'
    
if G == 2:
    nList = Pynet.ListUtils.ghDataTreeToPythonList(Vy)
    AM_abs = [abs(sum(l)/len(l)) for l in nList]
    print 'Shear force Vy [kN]'
    
if G == 3:
    nList = Pynet.ListUtils.ghDataTreeToPythonList(Mt)
    AM_abs = [abs(sum(l)/len(l)) for l in nList]
    print 'Torsional moment Mt [kNm]'
    
if G == 4:
    nList = Pynet.ListUtils.ghDataTreeToPythonList(My)
    AM_abs = [abs(sum(l)/len(l)) for l in nList]
    print 'Moment My [kNm]'
    
if G == 5:
    nList = Pynet.ListUtils.ghDataTreeToPythonList(Mz)
    AM_abs = [abs(sum(l)/len(l)) for l in nList]
    print 'Moment Mz [kNm]'
# ---------- end python_26 ----------
structural_analysis_information = Panel(python_26.out)
data_3 = Data(python_26.AM_abs)
python_27 = PythonScript(AM_abs=data_3)  # -> L0, L1; inputs AM_abs: list
# ---------- python_27: Python ----------
L0 = min(AM_abs)
L1 = max(AM_abs)
# ---------- end python_27 ----------
gradient = Gradient(LowerLimit=python_27.L0, UpperLimit=python_27.L1, Parameter=data_3, stops=[0: RGB(0, 192, 0), 0.691: RGB(192, 0, 0)])
ahsv = SplitAHSV(Colour=gradient)  # -> Alpha, Hue, Saturation, Value
python_28 = PythonScript(G=python_22, H=ahsv.Hue, S=ahsv.Saturation, L=ahsv.Value)  # inputs G: list of Curve, H: list, S: list, L: list
# ---------- python_28: Python ----------
import Rhino.Geometry as rg
import Grasshopper as gh
import Rhino as rc
import scriptcontext
from scriptcontext import sticky as st

def customDisplay(toggle,component):
    
    """ Make a custom display which is unique to the component and lives in sticky """
    
    # Make unique name and custom display
    displayGuid = "customDisplay_" + str(component.InstanceGuid)
    if displayGuid not in st:
        st[displayGuid] = rc.Display.CustomDisplay(True)
        
    # Clear display each time component runs
    st[displayGuid].Clear()
    
    # Return the display or get rid of it
    if toggle:
        return st[displayGuid]
    else:
        st[displayGuid].Dispose()
        del st[displayGuid]
        return None

dis = customDisplay(True, ghenv.Component)

color = []
for i in range(len(H)):
    color.append(rc.Display.ColorHSL(H[i],S[i],L[i]))

for i in range(len(G)):
    print G[i]
    dis.AddCurve(G[i], color[i], 2)
# ---------- end python_28 ----------

# ----
mesh_5 = Mesh(python_23.Mesh)

# ---- group: Get Neighboring Curves
python_29 = PythonScript(item=data)  # -> out, SelectedCurves_Sorted, SelectedLinesIndices; inputs item: Int32
# ---------- python_29: Python ----------
##----------------------------------------------------------------------------------------------------
## Import internal libraries
import Rhino.Geometry as rg
from scriptcontext import sticky as st
from ghpythonlib import components as ghcomp
from copy import deepcopy
import math as m

## Import external libraries
import networkx as nx
import Pynet
from scriptcontext import sticky as st


##----------------------------------------------------------------------------------------------------
## Global variables

Graph = st['newGraph']
MS = st['MasterSurfaces']
Nodes = nx.get_node_attributes(Graph, 'point').values()
NodesIndices = nx.get_node_attributes(Graph, 'point').keys()
Edges = nx.get_edge_attributes(Graph, 'line').values()

##----------------------------------------------------------------------------------------------------
## Get all neighboring edges and neighboring nodes

SelectedNodes = Nodes[item]

Lines = []
for i in range(len(Edges)):
    Lines.append(rg.Line(Edges[i].ToNurbsCurve().PointAtNormalizedLength(0.0), Edges[i].ToNurbsCurve().PointAtNormalizedLength(1.0)))

SelectedLinesIndices = []
for i in range(len(Lines)):
    if rg.Point3d.DistanceTo(Lines[i].From, SelectedNodes) < 0.005 or rg.Point3d.DistanceTo(Lines[i].To, SelectedNodes) < 0.005:
        SelectedLinesIndices.append(i)
    else:
        pass

SelectedCurves = []
for i in range(len(SelectedLinesIndices)):
    SelectedCurves.append(Edges[SelectedLinesIndices[i]])

def FromMainNodeToExterior(CrvsOrLines):
    fromCenterToEndNodeEdges = []
    for i in range(len(CrvsOrLines)):
        print type(CrvsOrLines[i])
        if type(CrvsOrLines[i]) == rg.NurbsCurve or type(CrvsOrLines[i]) == rg.LineCurve:
            if CrvsOrLines[i].PointAtStart.DistanceTo(Nodes[item]) < 0.05:
                fromCenterToEndNodeEdges.append(CrvsOrLines[i])
            else:
                nE = CrvsOrLines[i].ToNurbsCurve()
                nE.Reverse()
                fromCenterToEndNodeEdges.append(nE)
        else:
            if CrvsOrLines[i].From.DistanceTo(Nodes[item]) < 0.05:
                fromCenterToEndNodeEdges.append(CrvsOrLines[i])
            else:
                nE = CrvsOrLines[i].ToNurbsCurve()
                nE.Reverse()
                fromCenterToEndNodeEdges.append(nE)
    return fromCenterToEndNodeEdges
    
SelectedCurves_Sorted = FromMainNodeToExterior(SelectedCurves)
# ---------- end python_29 ----------

# ----
curvepoint = PointOnCurve(python_29.SelectedCurves_Sorted, parameter=0.5)
cp = ClosestPoint(Point=curvepoint, Cloud=area.Centroid)  # -> ClosestPoint, flatten(CPIndex), Distance

python_30 = PythonScript(x=cp.CPIndex)  # -> a; inputs x: list
# ---------- python_30: Python ----------
# Removes Duplicates
a = list(set(x))
# ---------- end python_30 ----------
item = ListItem(List=mesh_4, Index=python_30, Wrap=True)
python_31 = PythonScript(M=item)  # -> Me; inputs M: list of Mesh
# ---------- python_31: Python ----------
# removes null items

Me = []
for m in M:
    if m is None:
        pass
    else:
        Me.append(m)
# ---------- end python_31 ----------
python_32 = PythonScript(M=flatten(item))  # -> out, NakedEdges; inputs M: list of Mesh
# ---------- python_32: Python ----------
import Rhino.Geometry as rg
import math as m
import Pynet

if len(M) == 0:
    pass
else:
    GlobalMesh = rg.Mesh()
    for i in range(len(M)):
        GlobalMesh.Append(M[i])
    NakedEdges = GlobalMesh.GetNakedEdges()
    if NakedEdges is None:
        pass
    else:
        Lines = [nk.GetSegments() for nk in NakedEdges]
        for i in range(len(Lines)):
            a = []
            for j in range(len(Lines[i])):
                a.append(Lines[i][j].From)
            PointAtStart = a
# ---------- end python_32 ----------
demesh_2 = DeconstructMesh(Mesh=flatten(python_31))  # -> flatten(Vertices), Faces, Colours, Normals
wbedges = WeaverbirdsMeshEdges(MeshOrPolylines=flatten(python_31))
entwine = Entwine(Branch00=demesh_2.Vertices, Branch01=wbedges, FlattenInputs=True)  # -> simplify(Result)
previewnakededges = BooleanToggle(True)
pointcloud_2 = BooleanToggle(False)
python_33 = PythonScript(PreviewNakedEdges=previewnakededges, G=python_32.NakedEdges)  # inputs PreviewNakedEdges: Boolean, G: list of Curve
# ---------- python_33: Python ----------
import Rhino.Geometry as rg
import Grasshopper as gh
import Rhino as rc
import scriptcontext
from scriptcontext import sticky as st

def customDisplay(toggle,component):
    
    """ Make a custom display which is unique to the component and lives in sticky """
    
    # Make unique name and custom display
    displayGuid = "customDisplay_" + str(component.InstanceGuid)
    if displayGuid not in st:
        st[displayGuid] = rc.Display.CustomDisplay(True)
        
    # Clear display each time component runs
    st[displayGuid].Clear()
    
    # Return the display or get rid of it
    if toggle:
        return st[displayGuid]
    else:
        st[displayGuid].Dispose()
        del st[displayGuid]
        return None

dis = customDisplay(True, ghenv.Component)

color = rc.Display.ColorHSL(0,0,0)
if PreviewNakedEdges == True:
    for i in range(len(G)):
        dis.AddCurve(G[i], color, 5)
else:
    pass
# ---------- end python_33 ----------
python_34 = PythonScript(PointCloud=pointcloud_2, MeshEdges=Toggle(True), PreviewGeo=entwine)  # inputs PointCloud: Boolean, MeshEdges: Boolean, PreviewGeo: tree
# ---------- python_34: Python ----------
import Rhino.Geometry as rg
import Grasshopper as gh
import Rhino as rc
import scriptcontext
from scriptcontext import sticky as st


def customDisplay(toggle,component):
    
    """ Make a custom display which is unique to the component and lives in sticky """
    
    # Make unique name and custom display
    displayGuid = "customDisplay_" + str(component.InstanceGuid)
    if displayGuid not in st:
        st[displayGuid] = rc.Display.CustomDisplay(True)
        
    # Clear display each time component runs
    st[displayGuid].Clear()
    
    # Return the display or get rid of it
    if toggle:
        return st[displayGuid]
    else:
        st[displayGuid].Dispose()
        del st[displayGuid]
        return None

# Unpack tree
PC,ME = [b for b in PreviewGeo.Branches]
Toggle = True
dis = customDisplay(Toggle,ghenv.Component)

ps1 = rc.Display.PointStyle.Simple

if PreviewGeo.DataCount:

    if PointCloud:
        color = rc.Display.ColorXYZ(0,0,0)
        dis.AddPoints(PC,color,ps1,4)
    if MeshEdges:
        for i in range(len(ME)):
            color = rc.Display.ColorXYZ(0.05,0.05,0.05)
            dis.AddLine(ME[i],color,1)
# ---------- end python_34 ----------
mcol = MeshColours(Mesh=item, Colours=ColourSwatch(SwatchColor=RGB(222, 222, 222)))

mesh_6 = Mesh(flatten([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]))
pointcloud_3 = BooleanToggle(True)
demesh_3 = DeconstructMesh(Mesh=flatten(mesh_6))  # -> flatten(Vertices), Faces, Colours, Normals
sections_2 = BooleanToggle(False)
wbedges_2 = WeaverbirdsMeshEdges(MeshOrPolylines=flatten(mesh_6))

entwine_2 = Entwine(Branch00=demesh_3.Vertices, Branch01=wbedges_2, FlattenInputs=True)  # -> simplify(Result)
python_35 = PythonScript(PointCloud=pointcloud_3, MeshEdges=Toggle(False), Sections=sections_2, PreviewGeo=entwine_2)  # inputs PointCloud: Boolean, MeshEdges: Boolean, PreviewGeo: tree
# ---------- python_35: Python ----------
import Rhino.Geometry as rg
import Grasshopper as gh
import Rhino as rc
import scriptcontext
from scriptcontext import sticky as st


def customDisplay(toggle,component):
    
    """ Make a custom display which is unique to the component and lives in sticky """
    
    # Make unique name and custom display
    displayGuid = "customDisplay_" + str(component.InstanceGuid)
    if displayGuid not in st:
        st[displayGuid] = rc.Display.CustomDisplay(True)
        
    # Clear display each time component runs
    st[displayGuid].Clear()
    
    # Return the display or get rid of it
    if toggle:
        return st[displayGuid]
    else:
        st[displayGuid].Dispose()
        del st[displayGuid]
        return None

# Unpack tree
PC,ME = [b for b in PreviewGeo.Branches]
Toggle = True
dis = customDisplay(Toggle,ghenv.Component)

ps1 = rc.Display.PointStyle.Simple

if PreviewGeo.DataCount:

    if PointCloud:
        color = rc.Display.ColorXYZ(0,0,0)
        dis.AddPoints(PC,color,ps1,2)
    if MeshEdges:
        for i in range(len(ME)):
            color = rc.Display.ColorXYZ(0.0,0.0,0.0)
            dis.AddLine(ME[i],color,1)
# ---------- end python_35 ----------

# ---- group: Vectors Extracted From the Global Network
crv_2 = Curve(python_29.SelectedCurves_Sorted)
pframe = PerpFrame(Curve=reparameterize(crv_2), Parameter=number_slider_3)
deplane = DeconstructPlane(Plane=pframe)  # -> Origin, XAxis, YAxis, ZAxis
move = Move(Geometry=deplane.Origin, Motion=deplane.ZAxis)  # -> Geometry, Transform
ln = Line(StartPoint=move.Geometry, EndPoint=deplane.Origin)
end = EndPoints(Curve=ln)  # -> Start, End
scalestress = Slider(130, range=1..1000)
vec2pt = Vector2Pt(PointA=end.Start, PointB=end.End, Unitize=True)  # -> Vector, Length
item_2 = ListItem(List=python_26.AM_abs, Index=python_29.SelectedLinesIndices, Wrap=True)
python_36 = PythonScript(x=vec2pt.Vector)  # -> a; inputs x: list
# ---------- python_36: Python ----------
if len(x) == 1:
    pass
else:
    a = x
# ---------- end python_36 ----------
multiplication = Multiplication(A=item_2, B=scalestress)
amp = Amplitude(Vector=python_36, Amplitude=multiplication)

# ----
mesh_7 = Mesh(mesh_5)
python_37 = PythonScript(T=mesh_7)  # -> O; inputs T: tree; same code as python
pshift = ShiftPaths(Data=mesh_7, Offset=python_37)
python_38 = PythonScript(D=pshift, O=python_37)  # -> out, a; inputs D: tree, O: Int32
# ---------- python_38: Python ----------
import Pynet

if O == 0:
    D.Flatten(None)
    a = D
else:
    a = D
# ---------- end python_38 ----------
python_39 = PythonScript(M=python_38.a)  # -> out, GlobalMesh, PointAtStart; inputs M: list of Mesh; same code as python_32
demesh_4 = DeconstructMesh(Mesh=python_39.GlobalMesh)  # -> Vertices, Faces, Colours, Normals
cp_2 = ClosestPoint(Point=deplane.Origin, Cloud=demesh_4.Vertices)  # -> simplify(ClosestPoint), CPIndex, Distance

item_3 = ListItem(List=gradient, Index=python_29.SelectedLinesIndices, Wrap=True)

# ---- group: PreviewForces
python_40 = PythonScript(Forces=item_2)  # -> T; inputs Forces: list
# ---------- python_40: Python ----------
T = [round(f,2) for f in Forces]
# ---------- end python_40 ----------
curvepoint_2 = PointOnCurve(ln, parameter=0.5)
swatch = ColourSwatch(SwatchColor=RGB(0, 0, 0))
python_41 = PythonScript(Li=flatten(ln), Pt=flatten(end.End), Col=flatten(item_3))  # inputs Li: list of Line, Pt: list of Point3d, Col: list of Color
# ---------- python_41: Python ----------
import Rhino.Geometry as rg
import Grasshopper as gh
import Rhino as rc
import scriptcontext
from scriptcontext import sticky as st

def customDisplay(toggle,component):
    
    """ Make a custom display which is unique to the component and lives in sticky """
    
    # Make unique name and custom display
    displayGuid = "customDisplay_" + str(component.InstanceGuid)
    if displayGuid not in st:
        st[displayGuid] = rc.Display.CustomDisplay(True)
        
    # Clear display each time component runs
    st[displayGuid].Clear()
    
    # Return the display or get rid of it
    if toggle:
        return st[displayGuid]
    else:
        st[displayGuid].Dispose()
        del st[displayGuid]
        return None

Toggle = True
dis = customDisplay(Toggle, ghenv.Component)

ps1 = rc.Display.PointStyle.Simple

for i in range(len(Li)):
    dis.AddLine(Li[i], Col[i], 4)
    dis.AddPoint(Pt[i], Col[i], ps1, 12)
# ---------- end python_41 ----------
screentext_2 = ScreenOrientedText(
    Text=python_40,
    Justification=5,
    Location=curvepoint_2,
    SizeFactor=Slider(0.22, range=0..1),
    Color=item_3,
    Depth=0,
    Absolute=True)

# ----
supp_2 = SupportKaramba(PosInd=python_39.PointAtStart, menu=[buttons(on, on, on, off, off, off)])
loads_2 = LoadsKaramba(ForceVector=simplify(amp), Local=Toggle(True), PosInd=simplify(cp_2.ClosestPoint), LCase=0, mode="Point")
meshtoshell = MeshToShellKaramba(Mesh=python_39.GlobalMesh, LDist=0.005)  # -> Point, Element, Info
clean = CleanTree(RemoveNulls=True, RemoveInvalid=True, RemoveEmpty=False, Tree=loads_2)
assemble_2 = AssembleModelKaramba(Elem=meshtoshell.Element, Support=supp_2, Load=clean, Material=matselect, LimitDistance_m=0.005)  # -> Model, Info, Mass_kg, CenterOfGravity
analyzethi_2 = AnalyzeThIKaramba(Model=assemble_2.Model)  # -> CalculatedModel, MaximumDisplacement_m, ResultingForceOfGravity_kN, ElasticEnergy_kNm
modelview = ModelViewKaramba(Model=analyzethi_2.CalculatedModel, LoadCaseFactorsForLinearSuperposition=1, IndexIncrementOfVisibleLoadcase=0)  # -> Model, DeformedMesh, DeformedAxes, DeformedModel
shellview = ShellViewKaramba(Model=modelview.Model)  # -> Model, MeshesOfRenderedShells, simplify(LegendColors), simplify(LegendTags)

explode = Slider(0, range=0..1)
previewstructuralanalysis = BooleanToggle(False)
python_42 = PythonScript(x=python_23.Profiles)  # -> flatten(a); same code as python

pointcloud_4 = BooleanToggle(True)
sections_3 = BooleanToggle(True)

python_43 = PythonScript(M=python_42)  # -> Me; inputs M: list of Mesh; same code as python_31

data_4 = Data(python_10.PatchesNodesIndices)
mjoin = MeshJoin(Meshes=mesh_5)  # -> simplify(Mesh)
cluster_2 = Cluster(mesh=mjoin)

python_44 = PythonScript(x=data_4)  # -> a; inputs x: tree
# ---------- python_44: Python ----------
a = x.BranchCount
# ---------- end python_44 ----------
wheel = ColourWheel(
    python_44,
    ColourGrips_Style=41,
    ColourGrips_Grip=[5.280571131, 2.138978478, 0.568182151, 3.709774805],
    ColourGrips_Lum=[0.605350093, 0.8965478414],
    ColourGrips_Range=[2.251855103, 2.251855103, 2.251855103, 2.251855103],
    ColourGrips_Sat=[1, 0.4475225652])

python_45 = PythonScript(Selected_NodesIndices=data, PatchesNodesIndices=data_4, ColorPatches=wheel)  # -> out, C; inputs Selected_NodesIndices: Int32, PatchesNodesIndices: tree of Int32, ColorPatches: list of Color
# ---------- python_45: Python ----------
from scriptcontext import sticky as st
import Pynet

PatchesNodesIndices = Pynet.ListUtils.ghDataTreeToPythonList(PatchesNodesIndices)

for i in range(len(PatchesNodesIndices)):
    if Selected_NodesIndices in PatchesNodesIndices[i]:
        C = ColorPatches[i]
# ---------- end python_45 ----------
mcol_2 = MeshColours(Mesh=cluster_2, Colours=graft(python_45.C))
dots = DotDisplay(Point=python_10.PatchesNodes, Colour=graft(wheel), Size=Slider(0.05, range=0..1))

item_4 = ListItem(List=shellview.MeshesOfRenderedShells, Index=0, Wrap=True)
mesh_8 = Mesh(mcol_2)
filter_2 = StreamFilter(Gate=previewstructuralanalysis, Stream0=mesh_8, Stream1=item_4)

# ---- group: Decompose Mesh
mesh_9 = Mesh(simplify(filter_2))
data_5 = Data(data)
python_46 = PythonScript(Selected_NodesIndices=graft(data_5), Node_TimberMembers=mesh_9, Amplitude=explode)  # -> out, flatten(M); inputs Selected_NodesIndices: Int32, Node_TimberMembers: list of Mesh
# ---------- python_46: Python ----------
from scriptcontext import sticky as st
import networkx as nx
import Rhino.Geometry as rg

Graph = st['newGraph']
Nodes = nx.get_node_attributes(Graph, 'point').values()

M = []
for i in range(len(Node_TimberMembers)):
    TypeMesh = rg.Mesh()
    TypeMesh.Append(Node_TimberMembers[i])
    if Node_TimberMembers[i] is None:
        M.append(None)
    else:
        Node_TimberMembers_Centroid = rg.AreaMassProperties.Compute(TypeMesh).Centroid
        MoveVec = rg.Point3d.Subtract(Node_TimberMembers_Centroid, Nodes[Selected_NodesIndices])
        MoveVec.Unitize()
        MoveVecScaled = rg.Vector3d.Multiply(MoveVec, Amplitude)
        TypeMesh.Translate(MoveVecScaled)
        M.append(TypeMesh)
# ---------- end python_46 ----------

# ----
mesh_10 = Mesh(flatten(python_46.M))
python_47 = PythonScript(M=flatten(mesh_10))  # -> Me; inputs M: list of Mesh; same code as python_31
demesh_5 = DeconstructMesh(Mesh=flatten(python_47))  # -> flatten(Vertices), Faces, Colours, Normals
wbedges_3 = WeaverbirdsMeshEdges(MeshOrPolylines=flatten(python_47))

entwine_3 = Entwine(Branch00=demesh_5.Vertices, Branch01=wbedges_3, Branch02=python_43, FlattenInputs=True)  # -> simplify(Result)
python_48 = PythonScript(Mesh=python_21, PointCloud=pointcloud_4, MeshEdges=Toggle(True), Sections=sections_3, PreviewGeo=entwine_3)  # inputs Mesh: list of Int32, PointCloud: Boolean, MeshEdges: Boolean, PreviewGeo: tree
# ---------- python_48: Python ----------
import Rhino.Geometry as rg
import Grasshopper as gh
import Rhino as rc
import scriptcontext
from scriptcontext import sticky as st


def customDisplay(toggle,component):
    
    """ Make a custom display which is unique to the component and lives in sticky """
    
    # Make unique name and custom display
    displayGuid = "customDisplay_" + str(component.InstanceGuid)
    if displayGuid not in st:
        st[displayGuid] = rc.Display.CustomDisplay(True)
        
    # Clear display each time component runs
    st[displayGuid].Clear()
    
    # Return the display or get rid of it
    if toggle:
        return st[displayGuid]
    else:
        st[displayGuid].Dispose()
        del st[displayGuid]
        return None

# Unpack tree
PC,ME,SC = [b for b in PreviewGeo.Branches]
Toggle = True
dis = customDisplay(Toggle,ghenv.Component)

ps1 = rc.Display.PointStyle.Simple
ps2 = rc.Display.PointStyle.ActivePoint
ps3 = rc.Display.PointStyle.X
ps4 = rc.Display.PointStyle.ControlPoint

if PreviewGeo.DataCount:
    if 0 in Mesh:
        if PointCloud:
            color = rc.Display.ColorXYZ(0.2,0.2,0.2)
            dis.AddPoints(PC,color,ps1,3)
        if MeshEdges:
            for i in range(len(ME)):
                color = rc.Display.ColorXYZ(0.05,0.05,0.05)
                dis.AddLine(ME[i],color,1)
    if 2 in Mesh:
        if Sections:
            for i in range(len(SC)):
                color = rc.Display.ColorXYZ(0.0,0.0,0.0)
                dis.AddCurve(SC[i].ToNurbsCurve(),color,2)
# ---------- end python_48 ----------

# ==== cluster Cluster
mesh = ClusterInput()
mesh_2 = Mesh(mesh)
python = PythonScript(T=mesh_2)  # -> O; inputs T: tree
# ---------- python: Python ----------
ListPathsFirstIndex = []
for i in range(T.BranchCount):
    ListPathsFirstIndex.append(T.Paths[i][0])
print ListPathsFirstIndex

def anydup(thelist):
  seen = set()
  for x in thelist:
    if x in seen: return True
    seen.add(x)
  return False

if anydup(ListPathsFirstIndex) == True:
    O = -1
else:
    O = 0
# ---------- end python ----------
pshift = ShiftPaths(Data=mesh_2, Offset=python)
mesh_3 = Mesh(pshift)
mesh_4 = ClusterOutput(mesh_3)

# ==== cluster Cluster_2
x = ClusterInput()
python = PythonScript(x=x)  # -> a
# ---------- python: Python ----------
a = x
# ---------- end python ----------
clean = CleanTree(RemoveNulls=True, RemoveInvalid=True, RemoveEmpty=False, Tree=python)
demesh = DeconstructMesh(Mesh=flatten(clean))  # -> flatten(Vertices), Faces, Colours, Normals
wbedges = WeaverbirdsMeshEdges(MeshOrPolylines=flatten(clean))
entwine = Entwine(Branch00=demesh.Vertices, Branch01=wbedges, FlattenInputs=True)  # -> simplify(Result)
R = ClusterOutput(entwine)
